# Grasshopper definition MultilayerTrajectory2.gh (Grasshopper 1.0.7)
# plug-ins: Bifocals

# ----
# Random Plane -- DO NOT DELETE
plane = Plane(Plane(origin=(0.4074456494, 0.0005296864264, 0.08786710908), x=(0.04495376355, 0.9988665571, -0.01564481236), y=(0.9988405997, -0.04521155935, -0.01653394613)))

# ----
# Create an "approaching" plane above the first and the last plane of the trajectory
number_slider = Slider(15, range=0..100)
curve = Curve(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)
divide_curve = DivideCurve(Curve=curve, Count=number_slider, Kinks=False)  # -> Points, Tangents, Parameters
xy_plane = XYPlane(Origin=divide_curve.Points)
flip_plane = FlipPlane(Plane=xy_plane, ReverseX=False, ReverseY=False, SwapAxes=True)
list_item = ListItem(List=flip_plane, Index=0, Wrap=True)  # -> Item1, Item
deconstruct_plane = DeconstructPlane(Plane=list_item.Item)  # -> Origin, XAxis, YAxis, ZAxis
deconstruct_plane_2 = DeconstructPlane(Plane=list_item.Item1)  # -> Origin, XAxis, YAxis, ZAxis
number_slider_2 = Slider(0.02, range=0..0.1)
negative = Negative(Value=deconstruct_plane.ZAxis)
negative_2 = Negative(Value=deconstruct_plane_2.ZAxis)
amplitude = Amplitude(Vector=negative, Amplitude=number_slider_2)
amplitude_2 = Amplitude(Vector=negative_2, Amplitude=number_slider_2)
move = Move(Geometry=list_item.Item, Motion=amplitude)  # -> Geometry, Transform
move_2 = Move(Geometry=list_item.Item1, Motion=amplitude_2)  # -> Geometry, Transform
merge = Merge(Data1=move.Geometry, Data2=flip_plane, Data3=move_2.Geometry)
list_item_2 = ListItem(List=merge, Index=0, Wrap=True)  # -> Item1, Item
plane_2 = Plane(list_item_2.Item1)
plane_3 = Plane(list_item_2.Item)

# ----
# Structure Parameters
number_slider_3 = Slider(3, range=0..4)

# ----
# Robot Without End Effector
ros = COMPASFABROSConnect(connect=Toggle(False))  # -> ros_client, is_connected; inputs port: Int32, connect: Boolean
#   port ip: The ip address ROS. Defaults to 127.0.0.1.
#   port port: The port of ROS. Defaults to 9090.
#   port connect: If True, connects to ROS. If False, disconnects from ROS. Defaults to False.
#   port ros_client: The ROS client.
#   port is_connected: True if connection established.
# ---------- ros: Python ----------
"""
Connect or disconnect to ROS.

COMPAS FAB v1.1.0
"""

from compas_ghpython import create_id
from ghpythonlib.componentbase import executingcomponent as component
from scriptcontext import sticky as st

from compas_fab.backends import RosClient


class ROSConnect(component):
    def RunScript(self, ip, port, connect):
        ros_client = None

        ip = ip or "127.0.0.1"
        port = port or 9090

        key = create_id(self, "ros_client")
        ros_client = st.get(key, None)

        if ros_client:
            st[key].close()
        if connect:
            st[key] = RosClient(ip, port)
            st[key].run(5)

        ros_client = st.get(key, None)
        is_connected = ros_client.is_connected if ros_client else False
        return (ros_client, is_connected)
# ---------- end ros ----------
robot = COMPASFABROSRobot(ros_client=ros.ros_client, load=Toggle(False))  # -> robot; inputs load: Boolean
#   port ros_client: The ROS client.
#   port load: If True, loads the robot from ROS. Defaults to False.
# ---------- robot: Python ----------
"""
Load robot directly from ROS.

COMPAS FAB v1.1.0
"""

from compas.scene import SceneObject
from compas_ghpython import create_id
from ghpythonlib.componentbase import executingcomponent as component
from scriptcontext import sticky as st


class ROSRobot(component):
    def RunScript(self, ros_client, load):
        key = create_id(self, "robot")

        if ros_client and ros_client.is_connected and load:
            # Load URDF from ROS
            st[key] = ros_client.load_robot(load_geometry=True, precision=12)
            st[key].scene_object = SceneObject(item=st[key].model)

        robot = st.get(key, None)
        if robot:  # client sometimes need to be restarted, without needing to reload geometry
            robot.client = ros_client
        return robot
# ---------- end robot ----------
info = Info()  # -> info
#   port info: Environment info.
# ---------- info: Python ----------
"""
Displays information about the active COMPAS environment.
"""

import compas_bootstrapper
from ghpythonlib.componentbase import executingcomponent as component

import compas


class CompasInfo(component):
    def RunScript(self):
        self.Message = "COMPAS v{}".format(compas.__version__)
        info = "COMPAS Version: {}\nEnvironment: {}"
        return info.format(compas.__version__, compas_bootstrapper.ENVIRONMENT_NAME)
# ---------- end info ----------

number_slider_4 = Slider(-270, range=-360..360)
number_slider_5 = Slider(-49, range=-360..360)
number_slider_6 = Slider(-98, range=-360..360)
number_slider_7 = Slider(-126, range=-360..360)
number_slider_8 = Slider(90, range=-360..360)
number_slider_9 = Slider(-166, range=-360..360)

# ----
# ---------------  Set Parameters  ---------------
i_am_using = ValueList({"Robot LL": 0, "Robot RR": 1}, selected="Robot RR")
# ↓↓↓↓↓↓↓↓↓↓↓ UR RTDE - Send Robotic Comands ↓↓↓↓↓↓↓↓↓↓↓
# Only work when you are connected to a robot
panel = Panel("a) Robot's IP Address")
robot_rr_ip = Panel("169.254.204.200")
robot_ll_ip = Panel("192.168.10.10")
stream_filter = StreamFilter(Gate=i_am_using, Stream0=robot_ll_ip, Stream1=robot_rr_ip)
panel_2 = Panel("b) Speed")
speed = Slider(2.95, range=0..3.14)
panel_3 = Panel("c)  Acceleration")
acceleration = Slider(1.03, range=0..3.14)
panel_4 = Panel("d) Blend Radius")
blend_radius = Slider(0.01, range=0..3.14)

# ----
# Process Robot-Captured
# Pick and Place Planes
place_plane = Plane(Plane(origin=(0.2858603818, -0.0405878783, 0.1118388604), x=(-0.9999329977, 0.0051177325, 0.0103831106), y=(0.005445974354, 0.9994782993, 0.03183505395)))
pflip = FlipPlane(Plane=place_plane, ReverseX=False, ReverseY=False, SwapAxes=True)
num = Number(90)
rad = Radians(Degrees=num)
pick_plane = Plane(Plane(origin=(0.1988360774, -0.3134684997, 0.1123996326), x=(0.0004631913279, 0.9996839606, 0.02513492268), y=(0.9999719674, -0.0006508721975, 0.007459269129)))
rotate = Rotate(Geometry=pflip, Angle=rad, Plane=pflip)  # -> Geometry, Transform
translate_pick_plane = GhPythonScript(pick_plane=pick_plane)  # -> out, plane_out
# ---------- translate_pick_plane: Python ----------
"""Provides a scripting component.
    Inputs:
        pick_plane: The pick plane sent from the robot
    Output:
        plane_out: Translated plane"""

__author__ = "ckc15"
__version__ = "2026.04.15"

import rhinoscriptsyntax as rs

import rhinoscriptsyntax as rs
import scriptcontext as sc
import Rhino.Geometry as rg
import compas.geometry


# Translation value
SHIFT = -0.009 # - 9 mm
plane = rg.Plane(pick_plane)

translation = rg.Vector3d(0, 0, SHIFT)
plane.Translate(translation)

# Output
plane_out = plane
# ---------- end translate_pick_plane ----------

# ----
# Dependencies
# compas 		2.1.0
# compas_rrc 	1.1.0
# compas-fab 	1.0.2
# compas-robots	0.4.0
panel_5 = Panel(info)

brep = Brep([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])

panel_6 = Panel("a) Visual Mesh")
mesh_join = MeshJoin(Meshes=brep)

pt = Point(Point(0, 0, 0.093))

# ----
# !! Don't forget to internalize your Inputs from Rhino !!
panel_7 = Panel("c) Tool's Frame")
xy_plane_2 = XYPlane(Origin=pt)

panel_8 = Panel(stream_filter)
boolean_toggle = BooleanToggle(True)  # disabled
boolean_toggle_2 = BooleanToggle(False)  # disabled
# ---------------  Actions  ---------------
toggle_freedrive = GhPythonScript(ip=panel_8, start_teach_mode=boolean_toggle, stop_teach_mode=boolean_toggle_2)  # -> a; disabled
# ---------- toggle_freedrive: Python ----------
import os
import math

from compas.rpc import Proxy
package_path = ghdoc.Path
path = os.path.abspath(os.path.join(package_path,"../robot"))

if start_teach_mode:   
    canvas = ghenv.Component.OnPingDocument()
#    path = os.path.abspath(os.path.dirname(canvas.FilePath))
    rtde = Proxy('fabrication', path=path)                         # stay in teach moded(freedrive) as long as this is True
    a = rtde.start_teach_mode(ip=ip)            # send message to robot
    ghenv.Component.Message = "Freedrive on"    # display message on GH component

if stop_teach_mode:   
    canvas = ghenv.Component.OnPingDocument()
    print (path)
    rtde = Proxy('fabrication', path=path)                          # stop teach mode if stop button pressed
    a = rtde.stop_teach_mode(ip=ip)             # send message to robot   
    ghenv.Component.Message = "Freedrive off"   # display message on GH component
# ---------- end toggle_freedrive ----------
panel_9 = Panel("Steps !")
# Send to a config
button = Button()
panel_10 = Panel("Notes")

panel_11 = Panel("Attach Collision Meshes")

geos = Geometry(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)

# ----
# Sample ARC 373 Pattern
point = Point(Point(0.2402472764, -0.3659929912, 0.2))
# a) Right Click
# b) Set One Plane
number_slider_10 = Slider(0.25, range=0..1)
brep_closest_point = BrepClosestPoint(Point=point, Brep=geos)  # -> Point, Normal, Distance
plane_4 = Plane(brep_closest_point.Point)
rectangle = Rectangle(Plane=PlaneXY(0, 0, 0), XSize=Slider(0.25, range=0..1), YSize=number_slider_10, Radius=0)  # -> Rectangle, Length
number_slider_11 = Slider(0.06, range=0..0.1)
rectangle_2 = Rectangle(Plane=PlaneXY(0, 0, 0), XSize=number_slider_11, YSize=number_slider_11, Radius=0)  # -> Rectangle, Length
rectangular_array = RectangularArray(Cell=rectangle_2.Rectangle, XCount=Slider(5, range=0..100), YCount=Slider(23, range=0..100))  # -> Geometry, Transform
list_length = ListLength(List=rectangular_array.Geometry)
random = Random(Range=Domain(0, 1), Number=list_length, Seed=Slider(73, range=0..100))
larger_than = LargerThan(FirstNumber=random, SecondNumber=Slider(0.8, range=0..1))  # -> LargerThan, OrEqualTo
cull_pattern = CullPattern(List=rectangular_array.Geometry, CullPattern=larger_than.LargerThan)
plane_5 = Plane(cull_pattern)
circle = Circle(Plane=plane_5, Radius=Slider(0.03, range=0..0.1))
item = ListItem(List=cull_pattern, Index=0, Wrap=True)  # -> Item1, Item
pln = Plane(item.Item)

# ----
# Generate Pick Plane
point_2 = Point(Point(0.2402472764, -0.3659929912, 0.2))
brep_closest_point_2 = BrepClosestPoint(Point=point_2, Brep=geos)  # -> Point, Normal, Distance
plane_6 = Plane(brep_closest_point_2.Point)
pflip_2 = FlipPlane(Plane=plane_6, ReverseX=False, ReverseY=False, SwapAxes=True)

# ----
# Autogenerate Layered Pick and Place Patterns
deplane = DeconstructPlane(Plane=plane_6)  # -> Origin, XAxis, YAxis, ZAxis
pt_2 = Point(Point(0.3493410343, 0, 0.08774604271))
pdecon = Deconstruct(Point=deplane.Origin)  # -> XComponent, YComponent, ZComponent
pdecon_2 = Deconstruct(Point=pt_2)  # -> XComponent, YComponent, ZComponent
pt_3 = ConstructPoint(XCoordinate=pdecon_2.XComponent, YCoordinate=pdecon_2.YComponent, ZCoordinate=pdecon.ZComponent)
xy = XYPlane(Origin=pt_3)
vec = VectorXYZ(XComponent=Slider(0, range=0..1), YComponent=Slider(0, range=0..1), ZComponent=Slider(0.011, range=0..1))  # -> Vector, Length
vec_2 = VectorXYZ(XComponent=Slider(0, range=0..1), YComponent=Slider(0, range=0..1), ZComponent=Slider(0.011, range=0..1))  # -> Vector, Length
num_divisions = Slider(8, range=0..10)
move_3 = Move(Geometry=xy, Motion=vec_2.Vector)  # -> Geometry, Transform
# Segmented Trajectories Format
move_4 = Move(Geometry=pflip_2, Motion=vec.Vector)  # -> Geometry, Transform
multilayer_trajectory_generation = GhPythonScript(
    pick_plane=translate_pick_plane.plane_out,
    init_place_plane=rotate.Geometry,
    num_levels=number_slider_3,
    start_level=Slider(0, range=0..4),
    num_divisions=num_divisions)  # -> out, full_trajectory, place_planes, segmented_trajectories, d, e, seg_tree, num_logs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; inputs pick_plane: Plane, init_place_plane: Plane, num_levels: Int32, start_level: Int32, num_divisions: Int32
# ---------- multilayer_trajectory_generation: Python ----------
"""
Generate waypoint planes for log pick and placement to build a structure with 
a user-defined number of layers
    Inputs:
        pick_plane: plane - The plane where logs are picked up
        
        init_place_plane: plane - The plane where logs are placed on the first
                         layer
        
        num_levels: int - The desired number of levels in the log structure
        
        start_level: int - The desired structure level at which trajectories
                    will start being created. Indexing starts at 0.
        
        num_divisions: int - The number of divisions the arcs will be split into
        
    Output:
        a: The a output variable"""

import rhinoscriptsyntax as rs
import scriptcontext as sc
import Rhino.Geometry as rg
import compas.geometry
from Grasshopper import DataTree
from Grasshopper.Kernel.Data import GH_Path
import math
import ghpythonlib.treehelpers as th


# Height offset between start and end planes and their approach plane
Z_OFFSET = 0.05

# Max height moving curve can take
MAX_ROBOT_HEIGHT = 0.5


# Calculate safe arc height that clears the structure and stays within robot
# limits.
def calculate_safe_arc_height(start_plane, end_plane, current_layer, 
                              layer_height):

    # Current structure height (we need to clear everything below current layer)
    structure_height = current_layer * layer_height
    
    # Get Z coordinates of start and end
    start_z = start_plane.Origin.Z
    end_z = end_plane.Origin.Z
    higher_z = max(start_z, end_z)
    
    # Clearance above structure (safety margin)
    clearance = 0.05  # 5cm clearance above structure
    
    # Minimum arc height needed to clear structure
    min_arc_height = max(0, structure_height - higher_z + clearance)
    
    # Default arc height for smooth motion
    default_arc_height = 0.15  # 15cm arc
    
    # Take the larger of minimum needed or default
    desired_arc_height = max(min_arc_height, default_arc_height)
    
    # Check against maximum robot height
    peak_height = higher_z + desired_arc_height
    if peak_height > MAX_ROBOT_HEIGHT:
        # Reduce arc height to stay within limits
        desired_arc_height = MAX_ROBOT_HEIGHT - higher_z - 0.02  # 2cm safety margin
    
    return max(desired_arc_height, 0.02)  # Minimum 2cm arc

# Create a bounded (by max_height) arc between a start and end plane. The
# beginning and end of the arc are vertical for Z_OFFSET units
def create_arc(start_plane, end_plane, max_height):
    
    start_pt = start_plane.Origin
    end_pt = end_plane.Origin
    
    # Set Z in approach planes to be Z_OFFSET above start and end planes
    start_approach = rg.Point3d(start_pt)
    start_approach.Z += Z_OFFSET
    
    end_approach = rg.Point3d(end_pt)
    end_approach.Z += Z_OFFSET
    
    # Identify the midpoint of the arc
    mid_x = (start_approach.X + end_approach.X) / 2.0
    mid_y = (start_approach.Y + end_approach.Y) / 2.0
    
    # Set arc highest point
    higher_approach_z = max(start_approach.Z, end_approach.Z)
    mid_z = higher_approach_z + arc_height
    
    mid_pt = rg.Point3d(mid_x, mid_y, mid_z)
    
    # Create an array of control points to define an arc
    control_pts = [start_pt, start_approach, mid_pt, end_approach, end_pt]
    
    # Create the arc defined the control points
    arc = rg.NurbsCurve.Create(False, 3, control_pts)
    
    return arc
    
# Divide a curve into a list (length = num_divisions) of planes
def curve_to_planes(curve, num_divisions, ref_plane):
    
    num_divisions = int(num_divisions)
    # Divide the curve
    curve.Domain = rg.Interval(0,1)
    curve_points = []
    step = 1.0 / num_divisions
    for i in range(num_divisions + 1):
        curve_points.append(i * step)
    
    curve_planes = []
    
    for t in curve_points:
        # Get the point and create reference planes to go along the curve at t
        point = curve.PointAt(t)
        # ref_plane = rg.Plane(pick_plane)
        
        # Create plane perpendicular to the curve at point
        plane = rg.Plane(point, ref_plane.XAxis, ref_plane.YAxis)
        # DEBUG plane.Flip() # Flip plane to align Z-axis
        
        curve_planes.append(plane)
        
    return curve_planes
    
    
# The difference in height between layers in the structure
LAYER_HEIGHT = 0.01 # OG (18.32 mm + 1 mm)-- Change based on testing
X_OFFSET = 0.0763 # Change based on testing prev. 0.0827
Y_OFFSET = 0.0763 # Change based on testing
X_ADJUST = 0.002 # Shift in x needed for 1st log in odd layers based on testing
Y_ADJUST = 0.002 # Shift in y needed for 2nd log in odd layers based on testing

place_planes = [] # Planes on the structure where logs will be placed
full_trajectory = DataTree[object]() # List of individual placement trajectories

# Planes organized by log & segment (rest-pick, pick-place, place-rest) for
# gripping
segmented_trajectories = DataTree[object]()

path_index = 0 # Log index
num_divisions = int(num_divisions)
num_levels = int(num_levels)

# Create a plane that the robot will rest at before starting the next layer
rest_plane = rg.Plane(pick_plane)
vert_translation = rg.Vector3d(0, 0, Z_OFFSET)
rest_plane.Translate(vert_translation)

# To debug
debug_pick = rest_plane
debug_place_layer0_log0 = None
debug_place_layer0_log1 = None
debug_base_planes = []

for layer in range(start_level, start_level + num_levels):
    z = LAYER_HEIGHT * layer # z is the z-value for the plane
    
    # Determine the proper orientation for the plane
    # EVEN layers have planes that are aligned with the init_place_plane
    # ODD layers have planes that are aligned with the init_place_plane rotated
    # 90 degrees
    
    plane = rg.Plane(init_place_plane)
    plane.Flip() # Debug FIXED THE FLIPPING ISSUE
    plane.Rotate(math.radians(90), rg.Vector3d.ZAxis, plane.Origin) # Reorient
    
    if layer % 2 != 0:
        plane.Rotate(math.radians(-90), rg.Vector3d.ZAxis,
                     plane.Origin)
                     
    """ debug
    # Vertically translate the pose to the z value for the layer
    vert_translation = rg.Vector3d(0, 0, z)
    plane.Translate(vert_translation)
    
    debug_base_planes.append(rg.Plane(plane))  # Capture base plane
    """
    # Set the X and Y locations of the robot:
    # - Two possible (x,y) per level
    # - Points on EVEN planes are are offset in X by X_OFFSET from
    # init_place_plane
    # - Points on ODD planes are are offset in Y by Y_OFFSET from
    # init_place_plane rotated 90 degrees
    for log_num in range(2):
        
        curr_plane = rg.Plane(init_place_plane) # Debug
        curr_plane.Flip() # Debug
        
        # EVEN layer
        if layer % 2 == 0:
            translation = rg.Vector3d(0, 0, z)
            if log_num == 1: # Second log
                translation = rg.Vector3d(X_OFFSET, 0, z)
                
        # ODD layer
        else:
            translation = rg.Vector3d(X_ADJUST+(X_OFFSET/2), -Y_OFFSET/2, z)
            if log_num == 1: # Second log
                translation = rg.Vector3d(X_OFFSET/2, (Y_OFFSET/2)-Y_ADJUST, z)
                
        curr_plane.Translate(translation)
        
        # DEBUG -- to fix gripper orientation
        if layer % 2 == 0:
            curr_plane.Rotate(math.radians(90), rg.Vector3d.ZAxis,
                              curr_plane.Origin)
        # DEBUG -- Reorient
        # else:
        #    curr_plane.Rotate(math.radians(90), rg.Vector3d.ZAxis, plane.Origin)
        
        
        # Capture specific planes for debugging
        if layer == 0 and log_num == 0:
            debug_place_layer0_log0 = rg.Plane(curr_plane)
        if layer == 0 and log_num == 1:
            debug_place_layer0_log1 = rg.Plane(curr_plane)
            
            
        # DEBUG After creating segments, check Z-axis direction
        print("Pick plane Z-axis:", pick_plane.ZAxis)
        print("Curr plane Z-axis:", curr_plane.ZAxis)
        print("Rest plane Z-axis:", rest_plane.ZAxis)
        
        
        
        place_planes.append(curr_plane)
        # print("Appending - Layer:", layer, "Log:", log_num, "Origin:", curr_plane.Origin)
        
        
        ############################################
        """ GENERATE PLANE CURVES FOR MOTION """
        ############################################
        
        
        # Create a plane that robot will visit to make placement a vertical drop
        align_plane = rg.Plane(curr_plane)
        vert_translation = rg.Vector3d(0, 0, Z_OFFSET)
        align_plane.Translate(vert_translation)
        
        # Calculate a safe arc height for motion
        arc_height = calculate_safe_arc_height(pick_plane, align_plane, layer, 
                                               LAYER_HEIGHT)
        

        # 1. Create list of planes along the rest to pick location line curve
        rest_to_pick_curve = rg.LineCurve(rest_plane.Origin, pick_plane.Origin)
        rest_to_pick_planes = curve_to_planes(rest_to_pick_curve,
                                               num_divisions, pick_plane)
        
        
        ### Create segment 0 (rest to pick) -- gripper closes after
        segment_0_path = GH_Path(path_index, 0)
        for plane in rest_to_pick_planes:
            segmented_trajectories.Add(plane, segment_0_path)
        
        
        # 2. Create list of planes along the pick to rest location line curve
        pick_to_rest_curve = rg.LineCurve(pick_plane.Origin, rest_plane.Origin)
        pick_to_rest_planes = curve_to_planes(pick_to_rest_curve,
                                               num_divisions, rest_plane)
        
        
        # 3. Create list of planes along the pick and align plane curve
        rest_to_align_curve = create_arc(rest_plane, align_plane, arc_height)
        rest_to_align_planes = curve_to_planes(rest_to_align_curve,
                                               num_divisions, align_plane)
        
        
        # 4. Create list of planes along the align and place plane curve
        align_to_place_curve = rg.LineCurve(align_plane.Origin,
                                            curr_plane.Origin)
        align_to_place_planes = curve_to_planes(align_to_place_curve,
                                               num_divisions, curr_plane)
        
        
        ### Create segment 1 (pick to align)
        segment_1_path = GH_Path(path_index, 1)
        for plane in pick_to_rest_planes:
            segmented_trajectories.Add(plane, segment_1_path)
        for plane in rest_to_align_planes:
            segmented_trajectories.Add(plane, segment_1_path)
            
            
        ### Create segment 2 (align to place) -- gripper opens after
        segment_2_path = GH_Path(path_index, 2)
        for plane in align_to_place_planes:
            segmented_trajectories.Add(plane, segment_2_path)
        
        
        # 5. Create list of planes along the place and align plane curve
        place_to_align_curve = rg.LineCurve(curr_plane.Origin,
                                            align_plane.Origin)
        place_to_align_planes = curve_to_planes(place_to_align_curve,
                                               num_divisions, align_plane)
        
        
        # 6. Create list of planes along the align to rest location curve
        align_to_rest_curve = create_arc(align_plane, rest_plane, arc_height)
        align_to_rest_planes = curve_to_planes(align_to_rest_curve,
                                               num_divisions, rest_plane)
        
        
        ### Create segment 3 (place to rest) -- gripper remains open
        segment_3_path = GH_Path(path_index, 3)
        for plane in place_to_align_planes:
            segmented_trajectories.Add(plane, segment_3_path)
        for plane in align_to_rest_planes:
            segmented_trajectories.Add(plane, segment_3_path)
            
        
        # DEBUG Check first and last plane of pick→place segment
        # print("First pick→place Z:", pick_to_place_planes[0].ZAxis)
        # print("Last pick→place Z:", pick_to_place_planes[-1].ZAxis)
        
        
        # Combine all three motions to form complete motion for one log
        complete_sequence = (rest_to_pick_planes + pick_to_rest_planes +
                             rest_to_align_planes + align_to_place_planes +
                             place_to_align_planes + align_to_rest_planes)
        
        
        # Add planes to the full trajectory
        path = GH_Path(path_index)
        for plane_test in complete_sequence:
            full_trajectory.Add(plane_test, path)
        
        path_index += 1
        
        
# Debug
    
    
# FLATTENED - All planes in sequence (single list)
all_planes_flat = []
for path_idx in range(path_index):
    path = GH_Path(path_idx)
    for plane in full_trajectory.Branch(path):
        all_planes_flat.append(plane)

# PER LAYER - DataTree organized by layer
per_layer_trajectory = DataTree[object]()
layer_index = 0
for layer in range(start_level, start_level + num_levels):
    layer_path = GH_Path(layer_index)
    # Get both logs for this layer
    log1_path = GH_Path(layer_index * 2)      # First log of layer
    log2_path = GH_Path(layer_index * 2 + 1)  # Second log of layer
    
    # Add all planes from both logs to this layer
    for plane in full_trajectory.Branch(log1_path):
        per_layer_trajectory.Add(plane, layer_path)
    for plane in full_trajectory.Branch(log2_path):
        per_layer_trajectory.Add(plane, layer_path)
    
    layer_index += 1

### DEBUG
# Convert input DataTree to something we can work with
# This is the key line:
seg_tree = th.tree_to_list(segmented_trajectories)
# seg_tree = segmented_trajectories.Branch(0)


print("="*60)

# """
print("Converted tree structure:")
print("Type:", type(seg_tree))
print("Length:", len(seg_tree))
print("First item:", type(seg_tree[0]) if seg_tree else "empty")
print("Length of inner component:", [len(seg_tree[0]) for seg in seg_tree])
print(seg_tree)
# """

print("SEGMENTED TRAJECTORIES INFO:")
print("Total branches:", segmented_trajectories.BranchCount)
print("Expected branches:", num_levels * 2 * 4, "(", num_levels, "levels × 2 logs × 4 segments )")
print("Paths:", [str(p) for p in segmented_trajectories.Paths])
print(segmented_trajectories.TopologyDescription)
print(segmented_trajectories.Paths)

print("="*60)
##########




# Outputs pt1
a = full_trajectory # What is currently reflected in the output structure
b = place_planes # What is currently reflected in the output structure
c = segmented_trajectories # Data tree: {log_index; segment_index}
d = debug_place_layer0_log0
e = debug_place_layer0_log1
# f = debug_base_planes
f = seg_tree # What is currently reflected in the output structure
num_logs = num_levels * 2

# Outputs pt2
flattened_planes = all_planes_flat    # All planes in one list (for full motion)
i = per_layer_trajectory      # Organized by layer {0}, {1}, {2}, {3}, ...
traj_by_log = full_trajectory   # Organized by individual log {0}, {1}, {2}, {3}, ...
k = place_planes              # Just the placement positions (no motion)
# ---------- end multilayer_trajectory_generation ----------
number_slider_12 = Slider(0, range=0..4)
number_slider_13 = Slider(0, range=0..320)
branch = TreeBranch(Tree=multilayer_trajectory_generation.full_trajectory, Path=number_slider_12, MaintainPaths=True)
item_2 = ListItem(List=multilayer_trajectory_generation.place_planes, Index=number_slider_12, Wrap=True)
panel_12 = Panel(multilayer_trajectory_generation.segmented_trajectories)
panel_13 = Panel(branch)

# ----
# Data tree: {log_index; segment_index}
# Single Segment Trajectory
number_slider_14 = Slider(0, range=0..10)
seg_idx = Slider(3, range=0..10)
generate_path_object = GhPythonScript(log_idx=number_slider_14, seg_idx=seg_idx)  # -> out, a
# ---------- generate_path_object: Python ----------
"""Creates a path object to access a segmented log DataTree.
    Inputs:
        log_idx: int
        seg_idx: int
    Outputs:
        path: GH_Path"""

__author__ = "ckc15"
__version__ = "2026.04.02"

import rhinoscriptsyntax as rs
from Grasshopper.Kernel.Data import GH_Path

path = GH_Path(log_idx, seg_idx)

# Output
a = path
# ---------- end generate_path_object ----------
branch_2 = TreeBranch(Tree=multilayer_trajectory_generation.segmented_trajectories, Path=generate_path_object.a, MaintainPaths=True)

# ----
# Send to a plane
button_2 = Button()  # disabled
move_to_target = GhPythonScript(speed=speed, accel=acceleration, send=button_2, ip=panel_8)  # -> a; disabled
# ---------- move_to_target: Python ----------
import os
import math
from compas.rpc import Proxy
from compas_rhino.conversions import plane_to_compas_frame

package_path = ghdoc.Path

if send:
    if not plane:
        ghenv.Component.Message = "No frame to move to!"
    else:
        canvas = ghenv.Component.OnPingDocument()
        path = os.path.abspath(os.path.join(package_path,"../../robot"))
        rtde = Proxy('fabrication', path=path)
        frame = plane_to_compas_frame(plane)
        nowait = True
        a = rtde.move_to_target(frame, speed, accel, nowait, ip=ip)
        ghenv.Component.Message = "Sent frame"
# ---------- end move_to_target ----------

# ----
# Slide to visualize the trajectory
number_slider_15 = Slider(0, range=0..1)

in_seconds = Slider(2.2, range=0..10)
in_seconds_2 = Slider(2.2, range=0..10)
# Send a trajectory
button_3 = Button()
in_seconds_3 = Slider(0.5, range=0..10)
# Send multiple trajectories
button_4 = Button()

# ----
# Manually Test the Gripper
toggle = BooleanToggle(False)
gripper_testing = GhPythonScript(close_gripper=toggle, ip=panel_8)  # -> a
# ---------- gripper_testing: Python ----------
"""Provides a scripting component.
    Inputs:
        close_gripper: Toggle -- close or open the gripper (gripper resting state is open)
        ip: IP address -- Robot IP address
    Output:
        a: The a output variable"""

import rhinoscriptsyntax as rs
import os
import math
import time
from scriptcontext import sticky as st
import Grasshopper.Kernel as gh
from compas.rpc import Proxy
from compas.geometry import Translation, Vector, Transformation, Frame
import ghpythonlib.treehelpers as th

package_path = ghdoc.Path

# signal = IO pin, value = True (close), False (open)
# Signal 1 is first solenoid in series; Signal 2 is second solenoid in series
signal = 1 # Set the default signal

# Close gripper
if close_gripper:
    
    path = os.path.abspath(os.path.join(package_path,"../../robot"))
    print path
    rtde = Proxy('fabrication', path=path)
    
    # signal = IO pin, value = True (open valve), False (close valve)
    rtde.set_digital_io(signal, True, ip=ip)
    
# Open gripper
if not close_gripper:
    
    path = os.path.abspath(os.path.join(package_path,"../../robot"))
    print path
    rtde = Proxy('fabrication', path=path)
    
    # Close Solenoid 1
    rtde.set_digital_io(signal, False, ip=ip)
    signal = 0
    
    # Let Solenoid 2 exhaust
    rtde.set_digital_io(signal, True, ip=ip)
    time.sleep(0.5)
    rtde.set_digital_io(signal, False, ip=ip)
    
    signal = 1 # Reset the default signal

else:
    ghenv.Component.Message = "Send has not been received yet" #display message on component = "Send has not been received yet"
# ---------- end gripper_testing ----------

# ----
# Calculate the trajectory from the "home"
# configuration to the "approach" start plane
# This component it outdated.
# 
# REPLACE : from compas_ghpython import draw_frame WITH: from compas_rhino.conversions import frame_to_rhino
# 
# &&&
# 
# REPLACE: planes.append(draw_frame(frame)) WITH:  planes.append(frame_to_rhino(frame))
button_5 = Button()

# ----
# COMPAS FAB Plan Segmented
# Trajectory Cartesian Motion
number_slider_16 = Slider(0.01, range=0..0.1)

panel_14 = Panel("b) Collision Mesh")
# 2) Attach tools and Collision Meshes
panel_15 = Panel("Attach Tool")
brep_2 = Brep(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)
mesh_join_2 = MeshJoin(Meshes=brep_2)

# ----
# 1) Load robot from ROS
# Change IP : when running ROS in an another machine (eg. Linux)
# Default   : when running a docker file
boolean_toggle_3 = BooleanToggle(True)
compas_fab_ros_connect = COMPASFABROSConnect(connect=boolean_toggle_3)  # -> ros_client, is_connected; inputs port: Int32, connect: Boolean; same code as ros
compas_fab_ros_robot = COMPASFABROSRobot(ros_client=compas_fab_ros_connect.ros_client, load=Toggle(True))  # -> robot; inputs load: Boolean; same code as robot

tool = COMPASFABAttachedTool(robot=compas_fab_ros_robot, visual_mesh=mesh_join, collision_mesh=mesh_join_2, tcf_plane=xy_plane_2)  # -> robot; inputs visual_mesh: Mesh, collision_mesh: Mesh
#   port visual_mesh: A visual mesh for the tool.
#   port collision_mesh: A collision mesh for the tool.
#   port tcf_plane: The frame of the tool in tool0 frame.
#   port group: The planning group to which the tool should be attached.
#   port connected_to: The link to which the tool should be connected to.
# ---------- tool: Python ----------
"""
Attach a tool to the robot.

COMPAS FAB v1.0.2
"""

from compas.geometry import Frame
from compas_rhino.conversions import mesh_to_compas
from compas_rhino.conversions import plane_to_compas_frame
from ghpythonlib.componentbase import executingcomponent as component

from compas_fab.robots import Tool


class AttachToolComponent(component):
    def RunScript(self, robot, visual_mesh, collision_mesh, tcf_plane, group, connected_to):
        if robot and robot.client and robot.client.is_connected and visual_mesh:
            if not collision_mesh:
                collision_mesh = visual_mesh

            c_visual_mesh = mesh_to_compas(visual_mesh)
            c_collision_mesh = mesh_to_compas(collision_mesh)

            if not tcf_plane:
                frame = Frame.worldXY()
            else:
                frame = plane_to_compas_frame(tcf_plane)
            tool = Tool(c_visual_mesh, frame, c_collision_mesh)

            robot.attach_tool(tool, group)

        return robot
# ---------- end tool ----------

# ----
# ↓↓↓ This is your complete Robot ↓↓↓
robot_2 = Data(tool)
info_2 = PythonScript(robot=robot_2)  # -> out, main_group_name
# ---------- info_2: Python ----------
if robot:
    robot.info()
    main_group_name = robot.main_group_name
# ---------- end info_2 ----------
panel_16 = Panel(info_2.out)

# ----
# Get Current Config
get_config = GhPythonScript(robot=robot_2, send=Button(), ip=panel_8)  # -> config, current_plane
# ---------- get_config: Python ----------
import os
from scriptcontext import sticky as st
#sticky is a persistent dictionary which can save values and also be acessed by other GH components
#we use it here with a custom key to store values we read from the robot
from compas.rpc import Proxy
from compas.geometry import Frame
from compas_rhino.conversions import frame_to_rhino
package_path = ghdoc.Path

config_key = 'config_{}'.format(str(ghenv.Component.InstanceGuid))
frame_key = 'frame_{}'.format(str(ghenv.Component.InstanceGuid))

if config_key not in st:
    st[config_key] = None

if frame_key not in st:
    st[frame_key] = None

if send:
    canvas = ghenv.Component.OnPingDocument()
    path = os.path.abspath(os.path.join(package_path,"../../robot"))
    print (path)
    rtde = Proxy('fabrication', path=path)
    a = rtde.get_config(ip=ip)
    st[config_key] = rtde.get_config(ip=ip)
    st[frame_key] = robot.forward_kinematics(st[config_key], group, options=dict(solver='model'))

config = st[config_key]
frame = st[frame_key]
current_plane = frame_to_rhino(frame)
# ---------- end get_config ----------

# ----
# FORWARD KINEMATICS
forward_kinematics = PythonScript(
    robot=robot_2,
    shoulder_pan=number_slider_4,
    shoulder_lift=number_slider_5,
    elbow=number_slider_6,
    wrist_1=number_slider_7,
    wrist_2=number_slider_8,
    wrist_3=number_slider_9)  # -> full_configuration
# ---------- forward_kinematics: Python ----------
import math
import Grasshopper
from compas_fab.robots.robot import Joint
from compas_fab.robots.robot import Configuration

if robot:
    joints = robot.get_configurable_joints()
    joint_types = [joint.type for joint in joints]
    joint_names = [joint.name for joint in joints]
    
    joint_positions = [ 
                        math.radians(shoulder_pan), math.radians(shoulder_lift), 
                        math.radians(elbow), math.radians(wrist_1), 
                        math.radians(wrist_2), math.radians(wrist_3)]
    
    full_configuration = Configuration(joint_positions, joint_types, joint_names)
    
print(full_configuration)
# ---------- end forward_kinematics ----------
compas_fab_forward_kinematics = COMPASFABForwardKinematics(robot=robot_2, config=forward_kinematics)  # -> frame; inputs use_only_model: Boolean
#   port config: The configuration to calculate the forward kinematics for.
#   port group: The planning group used for calculation. Defaults to the robot's main planning group.
#   port link: The link name to calculate forward kinematics for. Defaults to the robot's end effector.
#   port use_only_model: If True, use only the robot model instead of the connected backend to calculate FK.
#   port frame: The resulting frame.
# ---------- compas_fab_forward_kinematics: Python ----------
"""
Calculate the robot's forward kinematic for a given configuration.

COMPAS FAB v1.1.0
"""

from ghpythonlib.componentbase import executingcomponent as component


class ForwardKinematics(component):
    def RunScript(self, robot, config, group, link, use_only_model):
        frame = None
        if robot and config:
            options = {}
            if link:
                options["link"] = link
            if use_only_model:
                options["solver"] = "model"
            frame = robot.forward_kinematics(config, group, options=options)
        return frame
# ---------- end compas_fab_forward_kinematics ----------
ghpython_script = GhPythonScript(frames=compas_fab_forward_kinematics)  # -> planes; inputs frames: list
# ---------- ghpython_script: Python ----------
from compas_rhino.conversions import frame_to_rhino

planes =[]

for frame in frames: 
    planes.append(frame_to_rhino(frame))
# ---------- end ghpython_script ----------

compas_fab_plan_cartesian_motion = COMPASFABPlanCartesianMotion(robot=robot_2, planes=plane_2, start_configuration=forward_kinematics, compute=button_5)  # -> trajectory; inputs planes: list, attached_collision_meshes: list, path_constraints: list, compute: Boolean
#   port planes: The planes or frames through which the path is defined.
#   port start_configuration: The robot's full configuration, i.e. values for all configurable joints of the entire robot, at the starting position. Defaults to the all-zero configuration.
#   port group: The planning group used for calculation. Defaults to the robot's main planning group.
#   port attached_collision_meshes: A list of attached collision meshes to be included for planning.
#   port path_constraints: Optional constraints that can be imposed along the solution path. Note that path calculation won't work if the start_configuration violates these constraints. Defaults to None.
#   port max_step: The approximate distance between the calculated points. (Defined in the robot's units.) Defaults to 0.01.
#   port compute: If True, calculates a trajectory.
#   port trajectory: The calculated trajectory.
# ---------- compas_fab_plan_cartesian_motion: Python ----------
"""
Calculate a cartesian motion path (linear in tool space).

COMPAS FAB v1.1.0
"""

from compas_ghpython import create_id
from compas_rhino.conversions import plane_to_compas_frame
from ghpythonlib.componentbase import executingcomponent as component
from scriptcontext import sticky as st


class PlanCartesianMotion(component):
    def RunScript(
        self, robot, planes, start_configuration, group, attached_collision_meshes, path_constraints, max_step, compute
    ):
        key = create_id(self, "trajectory")

        max_step = float(max_step) if max_step else 0.01
        path_constraints = list(path_constraints) if path_constraints else None
        attached_collision_meshes = list(attached_collision_meshes) if attached_collision_meshes else None

        if robot and robot.client and robot.client.is_connected and start_configuration and planes and compute:
            frames = [plane_to_compas_frame(plane) for plane in planes]
            st[key] = robot.plan_cartesian_motion(
                frames,
                start_configuration=start_configuration,
                group=group,
                options=dict(
                    max_step=max_step,
                    path_constraints=path_constraints,
                    attached_collision_meshes=attached_collision_meshes,
                ),
            )

        trajectory = st.get(key, None)
        return trajectory
# ---------- end compas_fab_plan_cartesian_motion ----------
compas_fab_trajectory_visualize = COMPASFABTrajectoryVisualize(robot=robot_2, trajectory=compas_fab_plan_cartesian_motion)  # -> start_configuration, configurations, fraction, time, planes, P, V, A
#   port group: The planning group for which this trajectory was planned.
#   port trajectory: The calculated trajectory.
#   port start_configuration: The start configuration of the trajectory.
#   port configurations: The full configurations along the trajectory.
#   port fraction: Indicates the fraction of requested trajectory that was calculated, e.g. 1 means the full trajectory was found.
#   port time: The time which is needed to execute that trajectory at full speed.
#   port planes: The planes of the robot's end-effector.
#   port P: The positions along the trajectory
#   port V: The velocities along the trajectory
#   port A: The accelerations along the trajectory
# ---------- compas_fab_trajectory_visualize: Python ----------
"""
Visualizes a trajectory.

COMPAS FAB v1.1.0
"""

from compas_rhino.conversions import frame_to_rhino
from compas_ghpython.sets import list_to_ghtree
from ghpythonlib.componentbase import executingcomponent as component


class TrajectoryVisualize(component):
    def RunScript(self, robot, group, trajectory):
        start_configuration = None
        configurations = []
        fraction = 0.0
        time = 0.0

        planes = []
        positions = []
        velocities = []
        accelerations = []

        if robot and trajectory:
            group = group or robot.main_group_name

            for c in trajectory.points:
                configurations.append(
                    robot.merge_group_with_full_configuration(c, trajectory.start_configuration, group)
                )
                frame = robot.forward_kinematics(c, group, options=dict(solver="model"))
                planes.append(frame_to_rhino(frame))
                positions.append(c.positions)
                velocities.append(c.velocities)
                accelerations.append(c.accelerations)

            start_configuration = trajectory.start_configuration
            fraction = trajectory.fraction
            time = trajectory.time_from_start

        P = list_to_ghtree(list(zip(*positions)))
        V = list_to_ghtree(list(zip(*velocities)))
        A = list_to_ghtree(list(zip(*accelerations)))

        # return outputs if you have them; here I try it for you:
        return (start_configuration, configurations, fraction, time, planes, P, V, A)
# ---------- end compas_fab_trajectory_visualize ----------

# ----
# Calculate the trajectory from curve
number_slider_17 = Slider(0.01, range=0..0.1)
list_item_3 = ListItem(List=compas_fab_trajectory_visualize.configurations, Index=0, Wrap=True)  # -> Item1, Item
compas_fab_plan_cartesian_motion_2 = COMPASFABPlanCartesianMotion(
    robot=robot_2,
    planes=multilayer_trajectory_generation.flattened_planes,
    start_configuration=list_item_3.Item1,
    max_step=number_slider_17,
    compute=Button())  # -> trajectory; inputs planes: list, attached_collision_meshes: list, path_constraints: list, compute: Boolean; same code as compas_fab_plan_cartesian_motion
compas_fab_trajectory_visualize_2 = COMPASFABTrajectoryVisualize(robot=robot_2, trajectory=compas_fab_plan_cartesian_motion_2)  # -> start_configuration, configurations, fraction, time, planes, P, V, A; same code as compas_fab_trajectory_visualize

plan_motion_of_segmented_trajectories = GhPythonScript(
    robot=robot_2,
    seg_tree=multilayer_trajectory_generation.segmented_trajectories,
    start_configuration=list_item_3.Item1,
    num_logs=multilayer_trajectory_generation.num_logs,
    max_step=number_slider_16,
    compute=Toggle(True))  # -> planned_trajs, last_log_idx, success_status, status_report; inputs seg_tree: tree
# ---------- plan_motion_of_segmented_trajectories: Python ----------
"""
Automatically plan all trajectory segments
Inputs:
    robot: Robot model from COMPAS FAB
    seg_tree: list [segment][planes]
    start_configuration: Configuration - initial robot configuration
    group: str - robot group name (e.g., 'manipulator')
    num_logs: int - total number of logs
    max_step: float - maximum step along trajectory between planes
    compute: bool - trigger to start planning
Outputs:
    planned_trajs: DataTree of planned trajectories
    last_log_idx: int - Index of the log placed last in the structure
    success_status: list of success/failure for each segment
    status_report: status message
"""

from compas.geometry import Frame
from Grasshopper import DataTree
from Grasshopper.Kernel.Data import GH_Path
import Rhino.Geometry as rg
import ghpythonlib.treehelpers as th  # ADD THIS
# from compas_fab.backends.interfaces.PlanCartesianMotion

# Initialize outputs
planned_trajectories = DataTree[object]()
success = []
last_log_idx = 1
status = "Not started"

########## DEBUG

###################

if compute:
    print("Starting planning for {} logs...".format(num_logs))
    print(seg_tree)
    # Keep track of configuration between segments
    current_config = start_configuration
    
    num_seg = 4 # Three segments per log
    total_segments = num_logs * num_seg
    success_count = 0
    
    # DEBUG change back to range(num_logs) to plan for more than one log
    for log_idx in range(num_logs):
        print("=== Planning log {}/{} ===".format(log_idx + 1, num_logs))
        
        for seg_idx in range(num_seg):
            seg_name = ["rest-->pick", "pick-->align", "align-->place", "place-->rest"][seg_idx]
            
            # Calculate branch index
            # branch_idx = (log_idx * num_seg) + seg_idx # DEBUG restore -- 
            
            # DEBUG restore-- print("Segment {}: {} (branch {})".format(seg_idx, seg_name, branch_idx))
            print("Segment {}: {}".format(seg_idx, seg_name)) # DEBUG delete
            
            # Get all planes for the log
            # planes = seg_tree[branch_idx] # DEBUG restore
            planes = seg_tree.Branch(log_idx, seg_idx) # DEBUG delete
            
            print("Type", type(planes))
            print("{} waypoints".format(len(planes)))
            
            if not planes:
                print("ERROR: No planes found for segment {}-{}".format(log_idx, seg_idx))
                success.append(False)
                continue
            
            print("Planning {} waypoints...".format(len(planes)))
            
            # Convert Rhino planes to COMPAS frames
            frames_WCF = []
            for plane in planes:
                print("Type of Plane", (planes))
                frame = Frame(
                    [plane.Origin.X, plane.Origin.Y, plane.Origin.Z],
                    [plane.XAxis.X, plane.XAxis.Y, plane.XAxis.Z],
                    [plane.YAxis.X, plane.YAxis.Y, plane.YAxis.Z]
                )
                frames_WCF.append(frame)
            
            # Plan cartesian motion
#            try:
            trajectory = robot.plan_cartesian_motion(
                frames_WCF=frames_WCF,
                start_configuration=current_config,
#                group=group,
                options={
                    'max_step': max_step,
                    'avoid_collisions': True
                }
            )
            
            if trajectory:
                # Store in output tree
                output_path = GH_Path(log_idx, seg_idx)
                planned_trajectories.Add(trajectory, output_path)
                
                # Update configuration for next segment
                if hasattr(trajectory, 'points') and trajectory.points:
                    current_config = trajectory.points[-1]
                
                success.append(True)
                success_count += 1
                print("SUCCESS: Trajectory planned")
            else:
                success.append(False)
                print("FAILED: No trajectory returned")
                
#            except Exception as e:
#                success.append(False)
#                print("\nERROR: {}".format(str(e)))
    
    last_log_idx = log_idx
    status = "Planned {}/{} segments successfully".format(success_count, total_segments)
    print("{}".format(status))


# Outputs
planned_trajs = planned_trajectories  # DataTree: {log_index; segment_index}
success_status = success               # List of successes/failures
status_report = status                # Status message
# ---------- end plan_motion_of_segmented_trajectories ----------
flatten = FlattenTree(Tree=plan_motion_of_segmented_trajectories.planned_trajs, Path="{0}")
compas_fab_trajectory_visualize_3 = COMPASFABTrajectoryVisualize(robot=robot_2, trajectory=flatten)  # -> start_configuration, configurations, fraction, time, planes, P, V, A; same code as compas_fab_trajectory_visualize
flatten_2 = FlattenTree(Tree=compas_fab_trajectory_visualize_3.configurations, Path="{0}")

# ----
# Plan your trajectory
# Make Sure to use a "comfortable start configuration"
# This can be the current configuration of the robot or a configuration that you defined
# Test points
point_3 = Point([Point(0.4509854836, -0.1498950214, 0.1539997758), Point(0.3793329673, -0.05731061348, 0.1539997758), Point(0.4509854836, -0.01514946346, 0.1539997758), Point(0.3793329673, 0.03279850758, 0.1539997758)])
xy_plane_3 = XYPlane(Origin=point_3)
flip_plane_2 = FlipPlane(Plane=xy_plane_3, ReverseX=False, ReverseY=False, SwapAxes=True)
compas_fab_plan_cartesian_motion_3 = COMPASFABPlanCartesianMotion(robot=robot_2, planes=flip_plane_2, start_configuration=get_config.config, compute=Button())  # -> trajectory; inputs planes: list, attached_collision_meshes: list, path_constraints: list, compute: Boolean; same code as compas_fab_plan_cartesian_motion

move_to_config = GhPythonScript(config=forward_kinematics, speed=speed, accel=acceleration, send=button, ip=panel_8)  # -> a
# ---------- move_to_config: Python ----------
import os
import math

from compas.rpc import Proxy
package_path = ghdoc.Path

if send:
    if not config:
        ghenv.Component.Message = "No config to move to!"
    else:
        canvas = ghenv.Component.OnPingDocument()
        path = os.path.abspath(os.path.join(package_path,"../../robot"))
        rtde = Proxy('fabrication', path=path)
        nowait = True
        a = rtde.move_to_joints(config, speed, accel, nowait, ip=ip)
        ghenv.Component.Message = "Sent config"
# ---------- end move_to_config ----------

# ----
# Calculate the trajectory to return to the
# "home" configuration
list_item_4 = ListItem(List=compas_fab_trajectory_visualize_2.configurations, Index=0, Wrap=True)  # -> Item1, Item
compas_fab_constraints_from_target_confi = COMPASFABConstraintsFromTargetConfiguration(robot=robot_2, target_configuration=forward_kinematics)  # -> constraints
#   port target_configuration: The target configuration.
#   port tolerance_above: The tolerances above the targeted joint value of each configurable joint, defining the upper bound in radians/meters to be achieved.
#   port tolerance_below: The tolerances below the targeted joint value of each configurable joint, defining the lower bound in radians/meters to be achieved.
#   port group: The planning group for which we specify the constraint. Defaults to the robot's main planning group.
#   port constraints: A list joint constraints in radians/meters.
# ---------- compas_fab_constraints_from_target_confi: Python ----------
"""
Create joint constraints for each of the robot's configurable joints based on a given target configuration.

COMPAS FAB v1.1.0
"""

import math

from ghpythonlib.componentbase import executingcomponent as component


class ConstraintsFromTargetConfiguration(component):
    DEFAULT_TOLERANCE_METERS = 0.001
    DEFAULT_TOLERANCE_RADIANS = math.radians(1)

    def RunScript(self, robot, target_configuration, tolerance_above, tolerance_below, group):
        if robot and target_configuration:
            tolerance_above = tolerance_above or self._generate_default_tolerances(robot.get_configurable_joints(group))
            tolerance_below = tolerance_below or self._generate_default_tolerances(robot.get_configurable_joints(group))

            constraints = robot.constraints_from_configuration(
                configuration=target_configuration,
                tolerances_above=tolerance_above,
                tolerances_below=tolerance_below,
                group=group,
            )

            return constraints

    def _generate_default_tolerances(self, joints):
        return [self.DEFAULT_TOLERANCE_METERS if j.is_scalable() else self.DEFAULT_TOLERANCE_RADIANS for j in joints]
# ---------- end compas_fab_constraints_from_target_confi ----------
compas_fab_plan_motion = COMPASFABPlanMotion(
    robot=robot_2,
    goal_constraints=compas_fab_constraints_from_target_confi,
    start_configuration=list_item_4.Item1,
    compute=Button())  # -> trajectory; inputs goal_constraints: list, attached_collision_meshes: list, path_constraints: list, compute: Boolean
#   port goal_constraints: The goal to be achieved, defined in a set of constraints. Constraints can be very specific, for example defining value domains for each joint, such that the goal configuration is included, or defining a volume in space, to which a specific robot link (e.g. the end-effector) is required to move to.
#   port start_configuration: The robot's full configuration, i.e. values for all configurable joints of the entire robot, at the starting position. Defaults to the all-zero configuration.
#   port group: The planning group used for calculation. Defaults to the robot's main planning group.
#   port attached_collision_meshes: A list of attached collision meshes to be included for planning.
#   port path_constraints: Optional constraints that can be imposed along the solution path. Note that path calculation won't work if the start_configuration violates these constraints. Defaults to None.
#   port planner_id: The name of the algorithm used for path planning. Defaults to 'RRTConnect'
#   port compute: If True, calculates a trajectory.
#   port trajectory: The calculated trajectory.
# ---------- compas_fab_plan_motion: Python ----------
"""
Calculate a motion path.

COMPAS FAB v1.1.0
"""

from compas_ghpython import create_id
from ghpythonlib.componentbase import executingcomponent as component
from scriptcontext import sticky as st


class PlanMotion(component):
    def RunScript(
        self,
        robot,
        goal_constraints,
        start_configuration,
        group,
        attached_collision_meshes,
        path_constraints,
        planner_id,
        compute,
    ):
        key = create_id(self, "trajectory")

        path_constraints = list(path_constraints) if path_constraints else None
        attached_collision_meshes = list(attached_collision_meshes) if attached_collision_meshes else None
        planner_id = str(planner_id) if planner_id else "RRTConnect"

        if (
            robot
            and robot.client
            and robot.client.is_connected
            and start_configuration
            and goal_constraints
            and compute
        ):
            st[key] = robot.plan_motion(
                goal_constraints,
                start_configuration=start_configuration,
                group=group,
                options=dict(
                    attached_collision_meshes=attached_collision_meshes,
                    path_constraints=path_constraints,
                    planner_id=planner_id,
                ),
            )

        trajectory = st.get(key, None)
        return trajectory
# ---------- end compas_fab_plan_motion ----------
compas_fab_trajectory_visualize_4 = COMPASFABTrajectoryVisualize(robot=robot_2, trajectory=compas_fab_plan_motion)  # -> start_configuration, configurations, fraction, time, planes, P, V, A; same code as compas_fab_trajectory_visualize

geos_2 = Geometry(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)
mesh = Mesh([geos, geos_2])
attach_cm = GhPythonScript(robot=robot_2, meshes=mesh)  # inputs meshes: list of Mesh
# ---------- attach_cm: Python ----------
from compas_fab.robots import PlanningScene
from compas_fab.robots import CollisionMesh
from compas_rhino.conversions import mesh_to_compas

if robot:
    scene = PlanningScene(robot)
    scene.remove_collision_mesh("setup")
    i=0
    for m in meshes:
        mesh = mesh_to_compas(m)
        cm = CollisionMesh(mesh, "setup"+ str(i))
        scene.add_collision_mesh(cm)
        i+=1
# ---------- end attach_cm ----------

# ----
# Visualize a Segment
seg_idx_2 = Slider(6, range=0..64)
item_3 = ListItem(List=flatten, Index=seg_idx_2, Wrap=True)
compas_fab_trajectory_visualize_5 = COMPASFABTrajectoryVisualize(robot=robot_2, trajectory=item_3)  # -> start_configuration, configurations, fraction, time, planes, P, V, A; same code as compas_fab_trajectory_visualize

# ----
# Calculate the trajectory to return to the
# "home" configuration
compas_fab_constraints_from_target_confi_2 = COMPASFABConstraintsFromTargetConfiguration(robot=robot_2, target_configuration=forward_kinematics)  # -> constraints; same code as compas_fab_constraints_from_target_confi
list_item_5 = ListItem(List=flatten_2, Index=0, Wrap=True)  # -> Item1, Item
# Connect this to a send_trajectory,
# so the arm can return to its home position
compas_fab_plan_motion_2 = COMPASFABPlanMotion(
    robot=robot_2,
    goal_constraints=compas_fab_constraints_from_target_confi_2,
    start_configuration=list_item_5.Item1,
    compute=Button())  # -> trajectory; inputs goal_constraints: list, attached_collision_meshes: list, path_constraints: list, compute: Boolean; same code as compas_fab_plan_motion
compas_fab_trajectory_visualize_6 = COMPASFABTrajectoryVisualize(robot=robot_2, trajectory=compas_fab_plan_motion_2)  # -> start_configuration, configurations, fraction, time, planes, P, V, A; same code as compas_fab_trajectory_visualize

# ----
# Check Reachability on Key Planes
# INVERSE KINEMATICS for a list of Planes
# List of Planes
# it checks the furthest snd the closest plane to the robot base frame + (num_mid_planes) x random planes in between
# !! Z axis of the Planes should point downwards !!
# 
# !!! It doesn't check for Collisions !!!
# 
# !!! This component has been modified to work for a list of Planes !!!
number_slider_18 = Slider(2, range=0..5)
ghpython_script_2 = GhPythonScript(num_mid_planes=number_slider_18)  # -> planes_to_check; inputs planes: list of Plane, num_mid_planes: Int32
# ---------- ghpython_script_2: Python ----------
import Rhino.Geometry as rg
import random

planes_to_check = []
# Ensure the input list is valid
if not planes or len(planes) < 3:
    closest = None
    furthest = None
    random_planes = []
else:
    origin = rg.Point3d.Origin

    # Sort planes based on the distance from origin to the plane's origin
    planes_sorted = sorted(planes, key=lambda p: p.Origin.DistanceTo(origin))

    # Get closest and furthest
    closest = planes_sorted[0]
    furthest = planes_sorted[-1]

    # Select a random plane that is not the closest or furthest
    middle_planes = [p for p in planes if p != closest and p != furthest]
    
# If not enough middle planes, allow repetition or reduce number
    if len(middle_planes) >= num_mid_planes:
        random_planes = random.sample(middle_planes, num_mid_planes)
    elif len(middle_planes) > 0:
        num_mid_planes = len(middle_planes)
        random_planes = random.sample(middle_planes, k=num_mid_planes)
    else:
        # Fallback: pick from all if only 2 planes exist
        random_planes = random.choices(planes, k=num_mid_planes)

planes_to_check.append(closest)
planes_to_check.extend(random_planes)
planes_to_check.append(furthest)
# ---------- end ghpython_script_2 ----------
planes = Plane(ghpython_script_2)
compas_fab_inverse_kinematics = COMPASFABInverseKinematics(robot=compas_fab_ros_robot, planes=planes, compute=Button())  # -> configurations; inputs planes: list
#   port planes: The plane or frame to calculate the inverse kinematic for.
#   port start_configuration: If passed, calculates the inverse such that the joint positions differ the least from the start_configuration. Defaults to the zero configuration.
#   port group: The planning group used for calculation. Defaults to the robot's main planning group.
#   port configurations: The planning group's configuration.
# ---------- compas_fab_inverse_kinematics: Python ----------
"""
Calculate the robot's inverse kinematic for a given plane.

COMPAS FAB v1.0.2
"""

from compas_rhino.conversions import plane_to_compas_frame
from ghpythonlib.componentbase import executingcomponent as component



class MultipleInverseKinematics(component):
    def RunScript(self, robot, planes, start_configuration, group, compute):
    
        configurations = []
        if robot and robot.client and robot.client.is_connected and planes:
            for plane in planes:
                frame = plane_to_compas_frame(plane)
                config = robot.inverse_kinematics(frame, start_configuration, group)
                configurations.append(config)
                start_configuration = config
            
        return configurations
# ---------- end compas_fab_inverse_kinematics ----------

info_3 = PythonScript(robot=robot_2)  # -> out, main_group_name; same code as info_2
panel_17 = Panel(info_3.out)

# ----
# Merge the trajectories in
# the correct order
merge_2 = Merge(Data1=compas_fab_plan_cartesian_motion, Data2=flatten, Data3=compas_fab_plan_motion_2)  # -> flatten(Result)
panel_18 = Panel(merge_2)

value_list = ValueList({"0. current config": 0, "1. Inverse Kinematic Configs": 1, "2. Forward Kinematic config": 2, "3. Trajectory": 3, "4. List of Configurations": 4}, selected="3. Trajectory")
stream_filter_2 = StreamFilter(
    Gate=value_list,
    Stream0=get_config.config,
    Stream1=compas_fab_inverse_kinematics,
    Stream2=forward_kinematics,
    Stream3=merge_2)

# ----
# Visualization of Robot's Movements
boolean_toggle_4 = BooleanToggle(False)
ghpython_script_3 = GhPythonScript(robot=robot_2, selected=stream_filter_2, i=number_slider_15)  # -> config; inputs selected: list
# ---------- ghpython_script_3: Python ----------
import ghpythonlib.components as ghcomp
import compas_fab
from compas_fab.robots.robot import Configuration

def remap(value, source_min, source_max, target_min, target_max):

    normalized_value = (value - source_min) / (source_max - source_min)
    
    remapped_value = target_min + normalized_value * (target_max - target_min)
    
    return remapped_value

def trajectory_points_to_configs(trajectory_points):
    configs = [] 
    for trajectory_point in trajectory_points:
        joint_values = list(trajectory_point.values())
        config = Configuration(joint_values, [0,0,0,0,0,0])
        configs.append(config)
    return configs

if isinstance(selected, list) and all(isinstance(t, compas_fab.robots.trajectory.JointTrajectory) for t in selected):
        # Flatten all trajectory points from all JointTrajectory objects
        all_points = []
        for traj in selected:
            all_points.extend(traj.points)
        print len (all_points)
        # Convert to configurations
        configs = trajectory_points_to_configs(all_points)

        # Remap index
        index = int(remap(i, 0.001, 1.00, 0, len(configs) - 1))
        index = min(max(0, index), len(configs) - 1)
        result = configs[index]
elif isinstance(selected,list ) and all(isinstance(c, Configuration) for c in selected):
    
    index = int(remap(i, 0.001, 1.00, 0, len(selected) - 1))
    index = min(max(0, index), len(selected) - 1)
    result = selected[index]
else:
    result = None  


config = result
# ---------- end ghpython_script_3 ----------
compas_fab_robot_visualize = COMPASFABRobotVisualize(
    robot=robot_2,
    configuration=ghpython_script_3,
    show_collision=boolean_toggle_4,
    show_cm=boolean_toggle_4,
    show_acm=boolean_toggle_4)  # -> visual, collision, collision_meshes, attached_meshes, frames, base_frame, ee_frame; inputs show_visual: Boolean, show_collision: Boolean, show_frames: Boolean, show_base_frame: Boolean, show_end_effector_frame: Boolean, show_cm: Boolean, show_acm: Boolean
#   port group: The planning group used for end-effector and base visualization.
#   port configuration: The robot's full configuration.
#   port show_visual: Whether or not to show the robot's visual meshes.
#   port show_collision: Whether or not to show the robot's collision meshes.
#   port show_frames: Whether or not to show the robot's joint frames.
#   port show_base_frame: Whether or not to show the robot's base frame.
#   port show_end_effector_frame: Whether or not to show the robot's end-effector frame.
#   port show_cm: Whether or not to show the collision meshes (if any).
#   port show_acm: Whether or not to show the attached collision meshes (if any).
#   port visual: Rhino meshes of the robot's visual geometry (if any).
#   port collision: Rhino meshes of the robot's collision geometry (if any).
#   port collision_meshes: Rhino meshes of the scene's collision meshes (if any).
#   port attached_meshes: Rhino meshes of the scene's attached collision meshes (if any).
#   port frames: The robot's joint frames as Rhino planes (if any).
#   port base_frame: The robot's base frame as a Rhino plane (if any).
#   port ee_frame: The robot's end-effector frame as a Rhino plane (if any).
# ---------- compas_fab_robot_visualize: Python ----------
"""
Visualizes the robot.

COMPAS FAB v1.0.2
"""

import time

from compas.geometry import Frame
from compas.geometry import Transformation
from compas.scene import SceneObject
from compas_ghpython import create_id
from compas_rhino.conversions import frame_to_rhino_plane
from ghpythonlib.componentbase import executingcomponent as component
from scriptcontext import sticky as st

from compas_fab.backends import BackendFeatureNotSupportedError
from compas_fab.robots import PlanningScene


class RobotVisualize(component):
    def RunScript(
        self,
        robot,
        group,
        configuration,
        show_visual,
        show_collision,
        show_frames,
        show_base_frame,
        show_end_effector_frame,
        show_cm,
        show_acm,
    ):
        visual = None
        collision = None
        collision_meshes = None
        attached_meshes = None
        frames = None
        base_frame = None
        ee_frame = None

        if robot:
            show_visual = True if show_visual is None else show_visual
            show_cm = True if show_cm is None else show_cm
            show_acm = True if show_acm is None else show_acm
            configuration = configuration or robot.zero_configuration()

            robot.update(configuration, visual=show_visual, collision=show_collision)
            compas_frames = robot.transformed_frames(configuration, group)

            if show_visual:
                visual = robot.scene_object.draw_visual()

            if show_collision:
                collision = robot.scene_object.draw_collision()

            if show_base_frame:
                base_compas_frame = compas_frames[0]
                base_frame = frame_to_rhino_plane(base_compas_frame)

            if show_end_effector_frame:
                options = dict(solver="model")
                if robot.attached_tool:
                    options["link"] = robot.attached_tool.connected_to

                ee_compas_frame = robot.forward_kinematics(configuration, group, options=options)
                ee_frame = frame_to_rhino_plane(ee_compas_frame)

            if show_frames:
                frames = []
                for compas_frame in compas_frames[1:]:
                    frame = frame_to_rhino_plane(compas_frame)
                    frames.append(frame)

            cached_scene_key = create_id(self, "cached_scene")

            if show_cm or show_acm:
                cached_scene = st.get(cached_scene_key)
                if not cached_scene:
                    cached_scene = {"time": 0}

                # expire cache if the component has not been executed in the last 2 seconds
                # this allows to slide through a list of configurations
                # without triggering refreshes of the scene in the middle of it
                if time.time() - cached_scene["time"] > 2:
                    update_scene = True
                else:
                    update_scene = False

                if update_scene:
                    scene = PlanningScene(robot)
                    try:
                        scene = robot.client.get_planning_scene()
                    except BackendFeatureNotSupportedError:
                        print(
                            "The selected backend does not support collision meshes. If you need collision mesh support, use a different backend."
                        )
                        scene = None
                        show_cm = False
                        show_acm = False

                if update_scene and show_cm:
                    collision_meshes = []

                    for co in scene.world.collision_objects:
                        header = co.header
                        frame_id = header.frame_id
                        cms = co.to_collision_meshes()

                        for cm in cms:
                            if cm.frame != Frame.worldXY():
                                t = Transformation.from_frame(cm.frame)
                                mesh = cm.mesh.transformed(t)
                            else:
                                mesh = cm.mesh
                            print type(mesh)
                            collision_meshes.extend(SceneObject(mesh).draw())

                        cached_scene["cm"] = collision_meshes

                collision_meshes = cached_scene.get("cm", [])

                if update_scene and show_acm:
                    attached_meshes = []

                    for aco in scene.robot_state.attached_collision_objects:
                        for acm in aco.to_attached_collision_meshes():
                            frame_id = aco.object["header"]["frame_id"]
                            frame = robot.forward_kinematics(configuration, options=dict(link=frame_id))
                            t = Transformation.from_frame(frame)

                            # Local CM frame
                            if acm.collision_mesh.frame and acm.collision_mesh.frame != Frame.worldXY():
                                t = t * Transformation.from_frame(acm.collision_mesh.frame)

                            mesh = acm.collision_mesh.mesh.transformed(t)
    
                            attached_meshes.extend(SceneObject(mesh).draw())

                    cached_scene["acm"] = attached_meshes

                attached_meshes = cached_scene.get("acm", [])

                cached_scene["time"] = time.time()
                st[cached_scene_key] = cached_scene

        return (
            visual,
            collision,
            collision_meshes,
            attached_meshes,
            frames,
            base_frame,
            ee_frame,
        )
# ---------- end compas_fab_robot_visualize ----------

pick_and_place = GhPythonScript(
    trajectories=merge_2,
    speed=speed,
    accel=acceleration,
    radius=blend_radius,
    stop_between=in_seconds_3,
    send=button_4,
    ip=panel_8)  # inputs trajectories: list
# ---------- pick_and_place: Python ----------
import os
import math
import time
from scriptcontext import sticky as st
import Grasshopper.Kernel as gh
from compas.rpc import Proxy
from compas.geometry import Translation, Vector, Transformation, Frame
import ghpythonlib.treehelpers as th

vaccum_io = 5
package_path = ghdoc.Path

#Check if value is true and sticky of the value has been updated
if send:
    if not trajectories: #if configs provided, then display message
        ghenv.Component.Message = "No trajectory to move to!"

    else:
        canvas = ghenv.Component.OnPingDocument()
        path = os.path.abspath(os.path.join(package_path,"../../robot"))
        print path
        rtde = Proxy('fabrication', path=path)
        rtde.send_multiple_trajectories(trajectories, speed, accel, radius, stop_between, ip)
        
        ghenv.Component.Message = "Sent frames" #display message on component
        
else:
    ghenv.Component.Message = "Send has not been received yet" #display message on component = "Send has not been received yet"
# ---------- end pick_and_place ----------

# ----
# Merge the trajectories in the correct order
merge_3 = Merge(Data1=compas_fab_plan_cartesian_motion, Data2=compas_fab_plan_cartesian_motion_2, Data3=compas_fab_plan_motion)  # -> flatten(Result)
panel_19 = Panel(merge_3)

pick_and_place_2 = GhPythonScript(
    trajectory=merge_3,
    speed=speed,
    accel=acceleration,
    radius=blend_radius,
    stop_before=in_seconds,
    stop_after=in_seconds_2,
    send=button_3,
    ip=panel_8)
# ---------- pick_and_place_2: Python ----------
import os
import math
import time
from scriptcontext import sticky as st
import Grasshopper.Kernel as gh
from compas.rpc import Proxy
from compas.geometry import Translation, Vector, Transformation, Frame
import ghpythonlib.treehelpers as th

vaccum_io = 5
package_path = ghdoc.Path

#Check if value is true and sticky of the value has been updated
if send:
    if not trajectory: #if configs provided, then display message
        ghenv.Component.Message = "No trajectory to move to!"

    else:
        canvas = ghenv.Component.OnPingDocument()
        path = os.path.abspath(os.path.join(package_path,"../../robot"))
        print path
        rtde = Proxy('fabrication', path=path)
        rtde.send_trajectory_radius(trajectory, speed, accel, radius, stop_before, stop_after, ip)
        
        ghenv.Component.Message = "Sent frames" #display message on component
#        a = st['send_trajectory_key']

else:
    ghenv.Component.Message = "Send has not been received yet" #display message on component = "Send has not been received yet"
# ---------- end pick_and_place_2 ----------

# ----
# Send Trajectories and Gripper IO
# Control to the Robot
sending_traj_w_h_gripping = GhPythonScript(
    struct_trajectories=plan_motion_of_segmented_trajectories.planned_trajs,
    approach_trajectory=compas_fab_plan_cartesian_motion,
    homing_trajectory=compas_fab_plan_motion_2,
    speed=speed,
    accel=acceleration,
    radius=blend_radius,
    num_logs=multilayer_trajectory_generation.num_logs,
    send=Toggle(False),
    ip=panel_8)  # -> out; inputs struct_trajectories: tree
# ---------- sending_traj_w_h_gripping: Python ----------
"""
Send trajectories and gripper IO signals to the robot
Inputs:
    struct_trajectories: DataTree - organized as {log_index;segment_index}
                  where segment: 0=pick, 1=place, 2=rest; trajectories for
                  picking and placing movements
    approach_trajectory: Trajectory - Trajectory from start configuration to
                  struct_trajectories
    homing_trajectory: Trajectory - Trajectory from end of struct_trajectories
                  back to start configuration
    speed: float - movement speed
    accel: float - acceleration
    radius: float - blend radius
    num_logs: int - number of logs in structure
    send: bool - trigger to send
    ip: str - robot IP address
Outputs:
    status: execution status message
"""

import os
import math
import time
from scriptcontext import sticky as st
import Grasshopper.Kernel as gh
from Grasshopper.Kernel.Data import GH_Path
from compas.rpc import Proxy
from compas.geometry import Translation, Vector, Transformation, Frame
import ghpythonlib.treehelpers as th


# DEBUG -- MAY NOT NEED STICKY KEY LOGIC...
# STICKY_KEY = "send_executed_{}".format(ghenv.Component.InstanceGuid)
package_path = ghdoc.Path

""" DEBUG
print(st.get(STICKY_KEY,True))
print(st.get(STICKY_KEY,False))
"""

# Gripper Actuation Function
def actuate_gripper(close_gripper, ip, proxy):
    # time.sleep(1)
    # signal = IO pin, value = True (close), False (open)
    # Signal 1 is first solenoid in series; Signal 2 is second solenoid in series
    signal = 1 # Set the default signal
    
    # Close gripper
    if close_gripper:
        # print path
        # signal = IO pin, value = True (open valve), False (close valve)
        proxy.set_digital_io(signal, True, ip=ip)
        
    # Open gripper
    elif not close_gripper:
        # print path        
        # Close Solenoid 1
        proxy.set_digital_io(signal, False, ip=ip)
        signal = 0
        
        # Let Solenoid 2 exhaust
        proxy.set_digital_io(signal, True, ip=ip)
        time.sleep(0.5)
        proxy.set_digital_io(signal, False, ip=ip)
        
        signal = 1 # Reset the default signal
    
    else:
        ghenv.Component.Message = "Send has not been received yet" 
    time.sleep(1)  # Wait before continuing with trajectory
    pass
    
        
# Main control logic
if send:
    print("Test send1")
    if not (struct_trajectories and (approach_trajectory and homing_trajectory)):
        status = "No trajectories to execute!"  # Safe — just sets output
        a = status
        print(homing_trajectory)
    
    else:
        print("Testing 2")
        # st[STICKY_KEY] = True
#
#        if st.get(STICKY_KEY, True):
#            status = "Already executed. Reset send to False first."
#            print(status)
#        else:
#            print("Testing 3")
#            st[STICKY_KEY] = True
#            
#
        path = os.path.abspath(os.path.join(package_path, "../../robot"))
        print("Robot path:", path)
        
        rtde = Proxy('fabrication', path=path)
        
        print("Executing {} logs".format(num_logs))

        
        # Send approach trajectory
        rtde.send_trajectory_radius(approach_trajectory, speed, accel, radius, 
                                       False, True, ip)  # Stop at end
        time.sleep(2)  # Wait
        print("Testing 4")

        for log_idx in range(num_logs):
            # (DEBUG) -- Refresh proxy connection every 3 logs
            if (log_idx) > 0 and (log_idx % 3) == 0:
                print("Refreshing connection...")
                rtde = Proxy('fabrication', path=path)
            
            print("\n=== Placing log {}/{} ===".format(log_idx + 1,num_logs))
            
            # Get the three segments for this log
            pick_path = GH_Path(log_idx, 0)
            align_path = GH_Path(log_idx, 1)
            place_path = GH_Path(log_idx, 2)
            rest_path = GH_Path(log_idx, 3)
            
            # DEBUG -- May not need the list()
            pick_traj_branch = list(struct_trajectories.Branch(pick_path))
            align_traj_branch = list(struct_trajectories.Branch(align_path))
            place_traj_branch = list(struct_trajectories.Branch(place_path))
            rest_traj_branch = list(struct_trajectories.Branch(rest_path))
            
            # DEBUG -- list data type instead of trajectory data type
            pick_traj = pick_traj_branch[0]  # Get first (and only) item
            align_traj = align_traj_branch[0]  # Get first (and only) item
            place_traj = place_traj_branch[0]  # Get first (and only) item
            rest_traj = rest_traj_branch[0]  # Get first (and only) item
            
            
            # ENSURE GRIPPER IS OPEN
            print("Opening gripper...")
            actuate_gripper(False, ip, rtde)
            
            
            print("Traj type{}".format(type(pick_traj)))
            # 1. Execute pick trajectory (move to log)
            print("Moving to pick location...")
            # rtde.send_trajectory_radius(pick_traj, speed, accel, radius, 
            #                           False, True, ip)  # Stop at end
            rtde.send_multiple_trajectories([pick_traj], speed, 
                                            accel, radius, 1, ip)
            time.sleep(2)  # Wait
            
            # 2. Close gripper
            print("Closing gripper...")
            actuate_gripper(True, ip, rtde)
            time.sleep(2)  # Wait
            
            # DEBUG -- reduce wait times - Pause for 1 second at place plane
            rtde.send_multiple_trajectories([align_traj, place_traj], speed, 
                                            accel, radius, 1, ip)
                                       
            """# 3. Execute align trajectory (move to alignment plane)
            print("Moving to alignment location...")
            rtde.send_trajectory_radius(align_traj, speed, accel, radius, 
                                       False, True, ip)  # Stop at end
            time.sleep(2)  # Wait
            
            # 4. Execute place trajectory (move to placement)
            print("Moving to placement location...")
            rtde.send_trajectory_radius(place_traj, speed, accel, radius, 
                                       False, True, ip)  # Stop at end
            """
            time.sleep(2)  # Wait
            
            # 5. Open gripper
            print("Opening gripper...")
            actuate_gripper(False, ip, rtde)
            time.sleep(2)  # Wait
            
            # 6. Execute rest trajectory (return to rest)
            print("Returning to rest...")
            # rtde.send_trajectory_radius(rest_traj, speed, accel, radius, 
            #                           False, True, ip)  # Stop at end
            rtde.send_multiple_trajectories([rest_traj], speed, 
                                            accel, radius, 1, ip)
                                            
            time.sleep(2)  # Wait
            print("Log {} placed successfully!".format(log_idx + 1))
        
        print("Completed {} logs!".format(num_logs))
        status = "Successfully placed {} logs".format(num_logs)
        
        # Send homing trajectory
        rtde.send_trajectory_radius(homing_trajectory, speed, accel, radius, 
                                       False, True, ip)  # Stop at end
    
else:
    # st[STICKY_KEY] = False  # Reset latch when send goes False
    ghenv.Component.Message = "Waiting for send signal..."
    status = "Ready"
    print(type(approach_trajectory))
    pick_path = GH_Path(0, 0)
    print(struct_trajectories.Branch(pick_path))

        
# Output
a = status
# ---------- end sending_traj_w_h_gripping ----------

panel_20 = Panel(sending_traj_w_h_gripping)
