# Grasshopper definition Computational_Art.ghx (Grasshopper 1.0.7)
# plug-ins: Bifocals

# ----
# Robot
robot = Geometry([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])

info = Info()  # -> info
#   port info: Environment info.
# ---------- info: Python ----------
"""
Displays information about the active COMPAS environment.
"""

import compas_bootstrapper
from ghpythonlib.componentbase import executingcomponent as component

import compas


class CompasInfo(component):
    def RunScript(self):
        self.Message = "COMPAS v{}".format(compas.__version__)
        info = "COMPAS Version: {}\nEnvironment: {}"
        return info.format(compas.__version__, compas_bootstrapper.ENVIRONMENT_NAME)
# ---------- end info ----------
# Dependencies
# compas 		2.1.0
# compas-fab 	1.0.2
# compas-robots	0.4.0
panel = Panel(info)

# ----
# 2.
# a) Right Click
# b) Set One Plane
# B.1.
# 2.
point = Point(Point(0.2388284677, 0.00593429807, 0.125))
xy_plane = XYPlane(Origin=point)

# ----
# 3.
geometry = Geometry(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)

# ----
# Import an Image
# 2.
# A.
path = FilePath("G:\.shortcut-targets-by-id\1kvZNQjcsWNOEUb7LucJAmD1fzkO3i1kC\00_XAIA Lab\06_Courses\01_2025_Creative Computation and Robotics\Admin\References\bunny1.png")
# 1.
img = ImportImage(File=path, Rectangle=geometry)

panel_2 = Panel(path)
seed = Slider(52, range=0..100)
# B.2.
size = Slider(0.025, range=0..1)
seed_2 = Slider(9, range=0..20)
seed_3 = Slider(15, range=0..20)
gap = Slider(0.005, range=0..0.01)
# 3.
size_2 = Slider(0.025, range=0..1)
schotter = GhPythonScript(x_size=size, y_size=size, gap=gap, x_cnt=seed_2, y_cnt=seed_3, seed=seed)  # -> out, rectangles; inputs x_cnt: Int32, seed: Int32
# ---------- schotter: Python ----------
import Rhino.Geometry as rg
import random

random.seed(seed)

rectangles =[]
for x_cnt in range(7):
    for y_cnt in range(20):
        rect = rg.Rectangle3d(rg.Plane.WorldXY, x_size, y_size)
        
        T_move = rg.Transform.Translation( rg.Vector3d( x_cnt* (gap+x_size), y_cnt*(gap+y_size), 0))
        
        rect.Transform(T_move)
        
        random_dist = gap*random.randint(0, y_cnt)
        
        T_rand_move = rg.Transform.Translation( rg.Vector3d(random_dist, -random_dist, 0))
        rect.Transform(T_rand_move)
        
        degree = 0.3* random.randint(-y_cnt, y_cnt)
        
        T_rand_rot = rg.Transform.Rotation(0.25+ degree, rect.Center)
        rect.Transform(T_rand_rot)
        
        rectangles.append(rect)
# ---------- end schotter ----------
# 1.
rectangle = Rectangle(Plane=xy_plane, XSize=size_2, YSize=size_2, Radius=0)  # -> Rectangle, Length
# 6.
number_slider = Slider(84, range=0..100)

# ----
# 5.
gap_2 = Slider(0.005, range=0..0.01)
addition = Addition(A=size_2, B=gap_2)
rectangle_2 = Rectangle(Plane=PlaneXY(0.2552584096, 0.00593429807, 0.125), XSize=addition, YSize=addition, Radius=0)  # -> Rectangle, Length

surface = Surface(schotter.rectangles)
# 5.
surface_2 = Surface(geometry)
# 4.
# 7.
divide_surface = DivideSurface(Surface=reparameterize(surface_2), UCount=number_slider, VCount=Slider(48, range=0..100))  # -> Points, Normals, Parameters
x_count = Slider(9, range=0..10)
y_count = Slider(15, range=0..100)

# ----
# 12.
flip_matrix = FlipMatrix(Data=divide_surface.Parameters)
flip_matrix_2 = FlipMatrix(Data=divide_surface.Points)

# ----
# 4.
rectangular_array = RectangularArray(Geometry=rectangle.Rectangle, Cell=rectangle_2.Rectangle, XCount=x_count, YCount=y_count)  # -> Geometry, Transform
# 8.
# a) Load the Image
# b) Set Domains 0 To 1
# c) Select the brightness
image = ImageSampler(
    flip_matrix,
    FilePath="G:\.shortcut-targets-by-id\1kvZNQjcsWNOEUb7LucJAmD1fzkO3i1kC\00_XAIA Lab\06_Courses\01_2025_Creative Computation and Robotics\Admin\References\bunny1.png",
    Filter="Value",
    Interpolate=False,
    Umax=1,
    Umin=0,
    Vmax=1,
    Vmin=0,
    Wrap=1)

# ----
# 4.
area = Area(Geometry=rectangular_array.Geometry)  # -> Area, Centroid
deconstruct = Deconstruct(Point=area.Centroid)  # -> XComponent, YComponent, ZComponent

# ----
# 10.
number_slider_2 = Slider(0.01, range=0..0.1)
deconstruct_2 = Deconstruct(Point=flip_matrix_2)  # -> XComponent, YComponent, ZComponent
multiplication = Multiplication(A=image, B=number_slider_2)
addition_2 = Addition(A=deconstruct_2.YComponent, B=multiplication)

# ----
# CALCULATES RANDOM ROTATION FROM -Y TO Y
negative = Negative(Value=deconstruct.YComponent)
# 5.
construct_domain = ConstructDomain(DomainStart=negative, DomainEnd=deconstruct.YComponent)
seed_4 = Slider(9, range=0..10)
list_length = ListLength(List=area.Centroid)
# 8.
# 10.
random = Random(Range=Domain(0, 1000), Number=list_length, Seed=seed_4, Integers=True)
# 6.
random_2 = Random(Range=construct_domain, Number=1, Seed=random)  # -> flatten(Random)
# 9.
multiplication_2 = Multiplication(A=random_2, B=Slider(100, range=0..500))

panel_3 = Panel("CALCULATES RANDOM TRANSLATION")
# 11.
panel_4 = Panel("0")
construct_domain_2 = ConstructDomain(DomainStart=panel_4, DomainEnd=deconstruct.YComponent)
random_3 = Random(Range=construct_domain_2, Number=1, Seed=random)  # -> flatten(Random)
# 12.
multiplication_3 = Multiplication(A=random_3, B=Slider(0.11, range=0..1))

# ----
# 10.
unit_y = UnitY(Factor=1)
amplitude = Amplitude(Vector=unit_y, Amplitude=multiplication)

# ----
# Option B.
# 9.
move = Move(Geometry=flip_matrix_2, Motion=amplitude)  # -> Geometry, Transform

# ----
# Option A.
# 9.
construct_point = ConstructPoint(XCoordinate=deconstruct_2.XComponent, YCoordinate=addition_2, ZCoordinate=deconstruct_2.ZComponent)

# ----
# 11.
interpolate = Interpolate(Vertices=move.Geometry, Degree=3, Periodic=False, KnotStyle=1)  # -> Curve, Length, Domain
# 7.
panel_5 = Panel(random_2)

# ----
# 13.
panel_6 = Panel("ROTATION")
rotate = Rotate(Geometry=rectangular_array.Geometry, Angle=multiplication_2, Plane=area.Centroid)  # -> Geometry, Transform

# ----
# 14.
unit_x = UnitX(Factor=multiplication_3)
panel_7 = Panel("TRANSLATION -> X")
move_2 = Move(Geometry=rotate.Geometry, Motion=unit_x)  # -> Geometry, Transform

# ----
# 15.
negative_2 = Negative(Value=multiplication_3)
panel_8 = Panel("TRANSLATION -> - Y")
unit_y_2 = UnitY(Factor=negative_2)
move_3 = Move(Geometry=move_2.Geometry, Motion=unit_y_2)  # -> Geometry, Transform
