# Grasshopper definition KinematicsAndPlanning.ghx (Grasshopper 1.0.7)
# plug-ins: Bifocals

info = Info()  # -> info
#   port info: Environment info.
# ---------- info: Python ----------
"""
Displays information about the active COMPAS environment.
"""

import compas_bootstrapper
from ghpythonlib.componentbase import executingcomponent as component

import compas


class CompasInfo(component):
    def RunScript(self):
        self.Message = "COMPAS v{}".format(compas.__version__)
        info = "COMPAS Version: {}\nEnvironment: {}"
        return info.format(compas.__version__, compas_bootstrapper.ENVIRONMENT_NAME)
# ---------- end info ----------

number_slider = Slider(-67, range=-360..360)
number_slider_2 = Slider(-83, range=-360..360)
number_slider_3 = Slider(-112, range=-360..360)
number_slider_4 = Slider(-62, range=-360..360)
number_slider_5 = Slider(61, range=-360..360)
# Option A.
# Import an Image
# 9.
# 10.
# 1.
# 2.
# 5.
# 3.
# 12.
# 4.
# 11.
# 7.
# 6.
# Option B.
# 8.
# 9.
# 10.
# a) Load the Image
# b) Set Domains 0 To 1
# c) Select the brightness
# 7.
# 2.
# 4.
# 5.
# a) Right Click
# b) Set One Plane
# 6.
# 2.
# 1.
# 4.
# 8.
# 3.
# 9.
# 5.
# 10.
# 11.
number_slider_6 = Slider(0, range=-360..360)

# ----
# Load robot from ROS
# Change IP : when running ROS in an another machine (eg. Linux)
# Default   : when running a docker file
boolean_toggle = BooleanToggle(True)
compas_fab_ros_connect = COMPASFABROSConnect(connect=boolean_toggle)  # -> ros_client, is_connected; inputs port: Int32, connect: Boolean
#   port ip: The ip address ROS. Defaults to 127.0.0.1.
#   port port: The port of ROS. Defaults to 9090.
#   port connect: If True, connects to ROS. If False, disconnects from ROS. Defaults to False.
#   port ros_client: The ROS client.
#   port is_connected: True if connection established.
# ---------- compas_fab_ros_connect: Python ----------
"""
Connect or disconnect to ROS.

COMPAS FAB v1.1.0
"""

from compas_ghpython import create_id
from ghpythonlib.componentbase import executingcomponent as component
from scriptcontext import sticky as st

from compas_fab.backends import RosClient


class ROSConnect(component):
    def RunScript(self, ip, port, connect):
        ros_client = None

        ip = ip or "127.0.0.1"
        port = port or 9090

        key = create_id(self, "ros_client")
        ros_client = st.get(key, None)

        if ros_client:
            st[key].close()
        if connect:
            st[key] = RosClient(ip, port)
            st[key].run(5)

        ros_client = st.get(key, None)
        is_connected = ros_client.is_connected if ros_client else False
        return (ros_client, is_connected)
# ---------- end compas_fab_ros_connect ----------
compas_fab_ros_robot = COMPASFABROSRobot(ros_client=compas_fab_ros_connect.ros_client, load=Toggle(True))  # -> robot; inputs load: Boolean
#   port ros_client: The ROS client.
#   port load: If True, loads the robot from ROS. Defaults to False.
# ---------- compas_fab_ros_robot: Python ----------
"""
Load robot directly from ROS.

COMPAS FAB v1.1.0
"""

from compas.scene import SceneObject
from compas_ghpython import create_id
from ghpythonlib.componentbase import executingcomponent as component
from scriptcontext import sticky as st


class ROSRobot(component):
    def RunScript(self, ros_client, load):
        key = create_id(self, "robot")

        if ros_client and ros_client.is_connected and load:
            # Load URDF from ROS
            st[key] = ros_client.load_robot(load_geometry=True, precision=12)
            st[key].scene_object = SceneObject(item=st[key].model)

        robot = st.get(key, None)
        if robot:  # client sometimes need to be restarted, without needing to reload geometry
            robot.client = ros_client
        return robot
# ---------- end compas_fab_ros_robot ----------
info_2 = PythonScript(robot=compas_fab_ros_robot)  # -> out, main_group_name
# ---------- info_2: Python ----------
if robot:
    robot.info()
    main_group_name = robot.main_group_name
# ---------- end info_2 ----------
panel = Panel(info_2.out)

# ----
# Dependencies
# compas 		2.13.0
# compas-fab 	1.1.0
# compas-robots	0.6.0
panel_2 = Panel(info)

# ----
# FORWARD KINEMATICS
forward_kinematics = PythonScript(
    robot=compas_fab_ros_robot,
    shoulder_pan=number_slider,
    shoulder_lift=number_slider_2,
    elbow=number_slider_3,
    wrist_1=number_slider_4,
    wrist_2=number_slider_5,
    wrist_3=number_slider_6)  # -> full_configuration
# ---------- forward_kinematics: Python ----------
import math
import Grasshopper
from compas_fab.robots.robot import Joint
from compas_fab.robots.robot import Configuration

if robot:
    joints = robot.get_configurable_joints()
    joint_types = [joint.type for joint in joints]
    joint_names = [joint.name for joint in joints]
    
    joint_positions = [ 
                        math.radians(shoulder_pan), math.radians(shoulder_lift), 
                        math.radians(elbow), math.radians(wrist_1), 
                        math.radians(wrist_2), math.radians(wrist_3)]
    
    full_configuration = Configuration(joint_positions, joint_types, joint_names)
    
print(full_configuration)
# ---------- end forward_kinematics ----------
compas_fab_forward_kinematics = COMPASFABForwardKinematics(robot=compas_fab_ros_robot, config=forward_kinematics)  # -> frame; inputs use_only_model: Boolean
#   port config: The configuration to calculate the forward kinematics for.
#   port group: The planning group used for calculation. Defaults to the robot's main planning group.
#   port link: The link name to calculate forward kinematics for. Defaults to the robot's end effector.
#   port use_only_model: If True, use only the robot model instead of the connected backend to calculate FK.
#   port frame: The resulting frame.
# ---------- compas_fab_forward_kinematics: Python ----------
"""
Calculate the robot's forward kinematic for a given configuration.

COMPAS FAB v1.1.0
"""

from ghpythonlib.componentbase import executingcomponent as component


class ForwardKinematics(component):
    def RunScript(self, robot, config, group, link, use_only_model):
        frame = None
        if robot and config:
            options = {}
            if link:
                options["link"] = link
            if use_only_model:
                options["solver"] = "model"
            frame = robot.forward_kinematics(config, group, options=options)
        return frame
# ---------- end compas_fab_forward_kinematics ----------
ghpython_script = GhPythonScript(frames=compas_fab_forward_kinematics)  # -> planes; inputs frames: list
# ---------- ghpython_script: Python ----------
from compas_rhino.conversions import frame_to_rhino

planes =[]

for frame in frames: 
    planes.append(frame_to_rhino(frame))
# ---------- end ghpython_script ----------

# ----
# INVERSE KINEMATICS
plane = Plane(Plane(origin=(0.03229588917, 0.3130730476, 0.2879448339), x=(0.8477042108, 0.2413523264, 0.4723839809), y=(0.3807167151, -0.8969123737, -0.2249510542)))
compas_fab_inverse_kinematics = COMPASFABInverseKinematics(robot=compas_fab_ros_robot, plane=plane)  # -> configuration
#   port plane: The plane or frame to calculate the inverse kinematic for.
#   port start_configuration: If passed, calculates the inverse such that the joint positions differ the least from the start_configuration. Defaults to the zero configuration.
#   port group: The planning group used for calculation. Defaults to the robot's main planning group.
#   port configuration: The planning group's configuration.
# ---------- compas_fab_inverse_kinematics: Python ----------
"""
Calculate the robot's inverse kinematic for a given plane.

COMPAS FAB v1.1.0
"""

from compas_rhino.conversions import plane_to_compas_frame
from ghpythonlib.componentbase import executingcomponent as component


class InverseKinematics(component):
    def RunScript(self, robot, plane, start_configuration, group):
        configuration = None
        if robot and robot.client and robot.client.is_connected and plane:
            frame = plane_to_compas_frame(plane)
            configuration = robot.inverse_kinematics(frame, start_configuration, group)
        return configuration
# ---------- end compas_fab_inverse_kinematics ----------

# ----
# PLAN CARTESIAN MOTION
# Start
# Mid
# End
# This component it outdated.
# 
# REPLACE : from compas_ghpython import draw_frame WITH: from compas_rhino.conversions import frame_to_rhino
# 
# &&&
# 
# REPLACE: planes.append(draw_frame(frame)) WITH:  planes.append(frame_to_rhino(frame))
plane_2 = Plane(Plane(origin=(-0.08643844272, 0.1441330426, 0.2462444448), x=(-0.7678103879, -0.4337259892, -0.4715389426), y=(-0.5266690657, 0.8463854251, 0.07906584269)))
plane_3 = Plane(Plane(origin=(0.2921190786, 0.005728711687, 0), x=(0.05276280448, 0.9986070731, 0), y=(0.9986070731, -0.05276280448, 0)))
plane_4 = Plane(Plane(origin=(0.03229588917, 0.3130730476, 0.2879448339), x=(0.8477042108, 0.2413523264, 0.4723839809), y=(0.3807167151, -0.8969123737, -0.2249510542)))
merge = Merge(Data1=plane_4, Data2=plane_3)
compas_fab_inverse_kinematics_2 = COMPASFABInverseKinematics(robot=compas_fab_ros_robot, plane=plane_2)  # -> configuration; same code as compas_fab_inverse_kinematics
compas_fab_plan_cartesian_motion = COMPASFABPlanCartesianMotion(
    robot=compas_fab_ros_robot,
    planes=merge,
    start_configuration=compas_fab_inverse_kinematics_2,
    max_step=Slider(0.25, range=0..1),
    compute=Button())  # -> trajectory; inputs planes: list, attached_collision_meshes: list, path_constraints: list, compute: Boolean
#   port planes: The planes or frames through which the path is defined.
#   port start_configuration: The robot's full configuration, i.e. values for all configurable joints of the entire robot, at the starting position. Defaults to the all-zero configuration.
#   port group: The planning group used for calculation. Defaults to the robot's main planning group.
#   port attached_collision_meshes: A list of attached collision meshes to be included for planning.
#   port path_constraints: Optional constraints that can be imposed along the solution path. Note that path calculation won't work if the start_configuration violates these constraints. Defaults to None.
#   port max_step: The approximate distance between the calculated points. (Defined in the robot's units.) Defaults to 0.01.
#   port compute: If True, calculates a trajectory.
#   port trajectory: The calculated trajectory.
# ---------- compas_fab_plan_cartesian_motion: Python ----------
"""
Calculate a cartesian motion path (linear in tool space).

COMPAS FAB v1.1.0
"""

from compas_ghpython import create_id
from compas_rhino.conversions import plane_to_compas_frame
from ghpythonlib.componentbase import executingcomponent as component
from scriptcontext import sticky as st


class PlanCartesianMotion(component):
    def RunScript(
        self, robot, planes, start_configuration, group, attached_collision_meshes, path_constraints, max_step, compute
    ):
        key = create_id(self, "trajectory")

        max_step = float(max_step) if max_step else 0.01
        path_constraints = list(path_constraints) if path_constraints else None
        attached_collision_meshes = list(attached_collision_meshes) if attached_collision_meshes else None

        if robot and robot.client and robot.client.is_connected and start_configuration and planes and compute:
            frames = [plane_to_compas_frame(plane) for plane in planes]
            print frames
            st[key] = robot.plan_cartesian_motion(
                frames,
                start_configuration=start_configuration,
                group=group,
                options=dict(
                    max_step=max_step,
                    path_constraints=path_constraints,
                    attached_collision_meshes=attached_collision_meshes,
                ),
            )

        trajectory = st.get(key, None)
        return trajectory
# ---------- end compas_fab_plan_cartesian_motion ----------
compas_fab_trajectory_visualize = COMPASFABTrajectoryVisualize(robot=compas_fab_ros_robot, trajectory=compas_fab_plan_cartesian_motion)  # -> start_configuration, configurations, fraction, time, planes, P, V, A
#   port group: The planning group for which this trajectory was planned.
#   port trajectory: The calculated trajectory.
#   port start_configuration: The start configuration of the trajectory.
#   port configurations: The full configurations along the trajectory.
#   port fraction: Indicates the fraction of requested trajectory that was calculated, e.g. 1 means the full trajectory was found.
#   port time: The time which is needed to execute that trajectory at full speed.
#   port planes: The planes of the robot's end-effector.
#   port P: The positions along the trajectory
#   port V: The velocities along the trajectory
#   port A: The accelerations along the trajectory
# ---------- compas_fab_trajectory_visualize: Python ----------
"""
Visualizes a trajectory.

COMPAS FAB v1.1.0
"""

from compas_rhino.conversions import frame_to_rhino
from compas_ghpython.sets import list_to_ghtree
from ghpythonlib.componentbase import executingcomponent as component


class TrajectoryVisualize(component):
    def RunScript(self, robot, group, trajectory):
        start_configuration = None
        configurations = []
        fraction = 0.0
        time = 0.0

        planes = []
        positions = []
        velocities = []
        accelerations = []

        if robot and trajectory:
            group = group or robot.main_group_name

            for c in trajectory.points:
                configurations.append(
                    robot.merge_group_with_full_configuration(c, trajectory.start_configuration, group)
                )
                frame = robot.forward_kinematics(c, group, options=dict(solver="model"))
                planes.append(frame_to_rhino(frame))
                positions.append(c.positions)
                velocities.append(c.velocities)
                accelerations.append(c.accelerations)

            start_configuration = trajectory.start_configuration
            fraction = trajectory.fraction
            time = trajectory.time_from_start

        P = list_to_ghtree(list(zip(*positions)))
        V = list_to_ghtree(list(zip(*velocities)))
        A = list_to_ghtree(list(zip(*accelerations)))

        # return outputs if you have them; here I try it for you:
        return (start_configuration, configurations, fraction, time, planes, P, V, A)
# ---------- end compas_fab_trajectory_visualize ----------

# ----
# PLAN FREE MOTION
# 13.
# 14.
# 15.
# 12.
compas_fab_constraints_from_plane = COMPASFABConstraintsFromPlane(robot=compas_fab_ros_robot, plane=plane_4)  # -> constraints
#   port plane: The plane or frame from which we create position and orientation constraints.
#   port group: The planning group for which we specify the constraint. Defaults to the robot's main planning group.
#   port tolerance_position: The allowed tolerance to the frame's position (defined in the robot's units). Defaults to 0.001
#   port tolerance_xaxis: The allowed tolerance of the frame's X-axis in degrees.
#   port tolerance_yaxis: The allowed tolerance of the frame's Y-axis in degrees.
#   port tolerance_zaxis: The allowed tolerance of the frame's Z-axis in degrees.
#   port constraints: A list containing a position and an orientation constraint.
# ---------- compas_fab_constraints_from_plane: Python ----------
"""
Create a position and an orientation constraint from a plane calculated for the group's end-effector link.

COMPAS FAB v1.1.0
"""

import math

from compas_rhino.conversions import plane_to_compas_frame
from ghpythonlib.componentbase import executingcomponent as component


class ConstraintsFromPlane(component):
    def RunScript(self, robot, plane, group, tolerance_position, tolerance_xaxis, tolerance_yaxis, tolerance_zaxis):
        goal_constraints = None
        if robot and plane:
            tolerance_position = tolerance_position or 0.001
            tolerance_xaxis = tolerance_xaxis or 1.0
            tolerance_yaxis = tolerance_yaxis or 1.0
            tolerance_zaxis = tolerance_zaxis or 1.0

            frame = plane_to_compas_frame(plane)
            tolerances_axes = [
                math.radians(tolerance_xaxis),
                math.radians(tolerance_yaxis),
                math.radians(tolerance_zaxis),
            ]
            goal_constraints = robot.constraints_from_frame(frame, tolerance_position, tolerances_axes, group)

        return goal_constraints
# ---------- end compas_fab_constraints_from_plane ----------
compas_fab_plan_motion = COMPASFABPlanMotion(
    robot=compas_fab_ros_robot,
    goal_constraints=compas_fab_constraints_from_plane,
    start_configuration=compas_fab_inverse_kinematics_2,
    compute=Button())  # -> trajectory; inputs goal_constraints: list, attached_collision_meshes: list, path_constraints: list, compute: Boolean
#   port goal_constraints: The goal to be achieved, defined in a set of constraints. Constraints can be very specific, for example defining value domains for each joint, such that the goal configuration is included, or defining a volume in space, to which a specific robot link (e.g. the end-effector) is required to move to.
#   port start_configuration: The robot's full configuration, i.e. values for all configurable joints of the entire robot, at the starting position. Defaults to the all-zero configuration.
#   port group: The planning group used for calculation. Defaults to the robot's main planning group.
#   port attached_collision_meshes: A list of attached collision meshes to be included for planning.
#   port path_constraints: Optional constraints that can be imposed along the solution path. Note that path calculation won't work if the start_configuration violates these constraints. Defaults to None.
#   port planner_id: The name of the algorithm used for path planning. Defaults to 'RRTConnect'
#   port compute: If True, calculates a trajectory.
#   port trajectory: The calculated trajectory.
# ---------- compas_fab_plan_motion: Python ----------
"""
Calculate a motion path.

COMPAS FAB v1.1.0
"""

from compas_ghpython import create_id
from ghpythonlib.componentbase import executingcomponent as component
from scriptcontext import sticky as st


class PlanMotion(component):
    def RunScript(
        self,
        robot,
        goal_constraints,
        start_configuration,
        group,
        attached_collision_meshes,
        path_constraints,
        planner_id,
        compute,
    ):
        key = create_id(self, "trajectory")

        path_constraints = list(path_constraints) if path_constraints else None
        attached_collision_meshes = list(attached_collision_meshes) if attached_collision_meshes else None
        planner_id = str(planner_id) if planner_id else "RRTConnect"

        if (
            robot
            and robot.client
            and robot.client.is_connected
            and start_configuration
            and goal_constraints
            and compute
        ):
            st[key] = robot.plan_motion(
                goal_constraints,
                start_configuration=start_configuration,
                group=group,
                options=dict(
                    attached_collision_meshes=attached_collision_meshes,
                    path_constraints=path_constraints,
                    planner_id=planner_id,
                ),
            )

        trajectory = st.get(key, None)
        return trajectory
# ---------- end compas_fab_plan_motion ----------
compas_fab_trajectory_visualize_2 = COMPASFABTrajectoryVisualize(robot=compas_fab_ros_robot, trajectory=compas_fab_plan_motion)  # -> start_configuration, configurations, fraction, time, planes, P, V, A; same code as compas_fab_trajectory_visualize
compas_fab_constraints_from_plane_2 = COMPASFABConstraintsFromPlane(robot=compas_fab_ros_robot, plane=plane_3)  # -> constraints; same code as compas_fab_constraints_from_plane
list_item = ListItem(List=compas_fab_trajectory_visualize_2.configurations, Index=0, Wrap=True)  # -> Item1, Item
compas_fab_plan_motion_2 = COMPASFABPlanMotion(
    robot=compas_fab_ros_robot,
    goal_constraints=compas_fab_constraints_from_plane_2,
    start_configuration=list_item.Item1,
    compute=Button())  # -> trajectory; inputs goal_constraints: list, attached_collision_meshes: list, path_constraints: list, compute: Boolean; same code as compas_fab_plan_motion
compas_fab_trajectory_visualize_3 = COMPASFABTrajectoryVisualize(robot=compas_fab_ros_robot, trajectory=compas_fab_plan_motion_2)  # -> start_configuration, configurations, fraction, time, planes, P, V, A; same code as compas_fab_trajectory_visualize

list_item_2 = ListItem(List=compas_fab_trajectory_visualize.configurations, Index=0, Wrap=True)  # -> Item1, Item

# ----
# Path Line
polyline = PolyLine(Vertices=compas_fab_trajectory_visualize.planes, Closed=False)

# ----
# Visualize Robot
compas_fab_robot_visualize = COMPASFABRobotVisualize(robot=compas_fab_ros_robot, configuration=compas_fab_inverse_kinematics)  # -> visual, collision, collision_meshes, attached_meshes, frames, base_frame, ee_frame; inputs show_visual: Boolean, show_collision: Boolean, show_frames: Boolean, show_base_frame: Boolean, show_end_effector_frame: Boolean, show_cm: Boolean, show_acm: Boolean
#   port group: The planning group used for end-effector and base visualization.
#   port configuration: The robot's full configuration.
#   port show_visual: Whether or not to show the robot's visual meshes.
#   port show_collision: Whether or not to show the robot's collision meshes.
#   port show_frames: Whether or not to show the robot's joint frames.
#   port show_base_frame: Whether or not to show the robot's base frame.
#   port show_end_effector_frame: Whether or not to show the robot's end-effector frame.
#   port show_cm: Whether or not to show the collision meshes (if any).
#   port show_acm: Whether or not to show the attached collision meshes (if any).
#   port visual: Rhino meshes of the robot's visual geometry (if any).
#   port collision: Rhino meshes of the robot's collision geometry (if any).
#   port collision_meshes: Rhino meshes of the scene's collision meshes (if any).
#   port attached_meshes: Rhino meshes of the scene's attached collision meshes (if any).
#   port frames: The robot's joint frames as Rhino planes (if any).
#   port base_frame: The robot's base frame as a Rhino plane (if any).
#   port ee_frame: The robot's end-effector frame as a Rhino plane (if any).
# ---------- compas_fab_robot_visualize: Python ----------
"""
Visualizes the robot.

COMPAS FAB v1.1.0
"""

import time

from compas.geometry import Frame
from compas.geometry import Transformation
from compas.scene import SceneObject
from compas_ghpython import create_id
from compas_rhino.conversions import frame_to_rhino_plane
from ghpythonlib.componentbase import executingcomponent as component
from scriptcontext import sticky as st

from compas_fab.backends import BackendFeatureNotSupportedError
from compas_fab.robots import PlanningScene


class RobotVisualize(component):
    def RunScript(
        self,
        robot,
        group,
        configuration,
        show_visual,
        show_collision,
        show_frames,
        show_base_frame,
        show_end_effector_frame,
        show_cm,
        show_acm,
    ):
        visual = None
        collision = None
        collision_meshes = None
        attached_meshes = None
        frames = None
        base_frame = None
        ee_frame = None

        if robot:
            show_visual = True if show_visual is None else show_visual
            show_cm = True if show_cm is None else show_cm
            show_acm = True if show_acm is None else show_acm
            configuration = configuration or robot.zero_configuration()

            robot.update(configuration, visual=show_visual, collision=show_collision)
            compas_frames = robot.transformed_frames(configuration, group)

            if show_visual:
                visual = robot.scene_object.draw_visual()

            if show_collision:
                collision = robot.scene_object.draw_collision()

            if show_base_frame:
                base_compas_frame = compas_frames[0]
                base_frame = frame_to_rhino_plane(base_compas_frame)

            if show_end_effector_frame:
                options = dict(solver="model")
                if robot.attached_tool:
                    options["link"] = robot.attached_tool.connected_to

                ee_compas_frame = robot.forward_kinematics(configuration, group, options=options)
                ee_frame = frame_to_rhino_plane(ee_compas_frame)

            if show_frames:
                frames = []
                for compas_frame in compas_frames[1:]:
                    frame = frame_to_rhino_plane(compas_frame)
                    frames.append(frame)

            cached_scene_key = create_id(self, "cached_scene")

            if show_cm or show_acm:
                cached_scene = st.get(cached_scene_key)
                if not cached_scene:
                    cached_scene = {"time": 0}

                # expire cache if the component has not been executed in the last 2 seconds
                # this allows to slide through a list of configurations
                # without triggering refreshes of the scene in the middle of it
                if time.time() - cached_scene["time"] > 2:
                    update_scene = True
                else:
                    update_scene = False

                if update_scene:
                    scene = PlanningScene(robot)
                    try:
                        scene = robot.client.get_planning_scene()
                    except BackendFeatureNotSupportedError:
                        print(
                            "The selected backend does not support collision meshes. If you need collision mesh support, use a different backend."
                        )
                        scene = None
                        show_cm = False
                        show_acm = False

                if update_scene and show_cm:
                    collision_meshes = []

                    for co in scene.world.collision_objects:
                        header = co.header
                        frame_id = header.frame_id
                        cms = co.to_collision_meshes()

                        for cm in cms:
                            if cm.frame != Frame.worldXY():
                                t = Transformation.from_frame(cm.frame)
                                mesh = cm.mesh.transformed(t)
                            else:
                                mesh = cm.mesh

                            collision_meshes.extend(SceneObject(item=mesh).draw())

                        cached_scene["cm"] = collision_meshes

                collision_meshes = cached_scene.get("cm", [])

                if update_scene and show_acm:
                    attached_meshes = []

                    for aco in scene.robot_state.attached_collision_objects:
                        for acm in aco.to_attached_collision_meshes():
                            frame_id = aco.object["header"]["frame_id"]
                            frame = robot.forward_kinematics(configuration, options=dict(link=frame_id))
                            t = Transformation.from_frame(frame)

                            # Local CM frame
                            if acm.collision_mesh.frame and acm.collision_mesh.frame != Frame.worldXY():
                                t = t * Transformation.from_frame(acm.collision_mesh.frame)

                            mesh = acm.collision_mesh.mesh.transformed(t)

                            attached_meshes.extend(SceneObject(item=mesh).draw())

                    cached_scene["acm"] = attached_meshes

                attached_meshes = cached_scene.get("acm", [])

                cached_scene["time"] = time.time()
                st[cached_scene_key] = cached_scene

        return (
            visual,
            collision,
            collision_meshes,
            attached_meshes,
            frames,
            base_frame,
            ee_frame,
        )
# ---------- end compas_fab_robot_visualize ----------

merge_2 = Merge(Data1=compas_fab_trajectory_visualize_2.configurations, Data2=compas_fab_trajectory_visualize_3.configurations)  # -> flatten(Result)
list_item_3 = ListItem(List=merge_2, Index=Slider(0, range=0..25), Wrap=True)

# ----
# Path Line
polyline_2 = PolyLine(Vertices=[compas_fab_trajectory_visualize_2.planes, compas_fab_trajectory_visualize_3.planes], Closed=False)
