# Grasshopper definition Link_with_GH_example.gh (Grasshopper 1.0.7)

ghpython_script = GhPythonScript()  # -> out, a
# ---------- ghpython_script: Python ----------
import os
import math
import time
from scriptcontext import sticky as st
import Grasshopper.Kernel as gh
from compas.rpc import Proxy

import ghpythonlib.treehelpers as th


package_path = ghdoc.Path


canvas = ghenv.Component.OnPingDocument()
path = os.path.abspath(os.path.join(package_path,"../scripts"))
messenger = Proxy('Messenger', path=path)

message = messenger.CommunicateWithGH()
print message
# ---------- end ghpython_script ----------
panel = Panel(ghpython_script.out)
