# Grasshopper definition ToolPathVisualization.ghx (Grasshopper 1.0.7)
# plug-ins: Bifocals

# ----
# 2.
# a) Right Click
# b) Set One Plane
# 2.
point = Point(Point(0.2388284677, 0.00593429807, 0.125))
xy_plane = XYPlane(Origin=point)

# ----
# 3.
# Import an Image
# 2.
# 3.
size = Slider(0.025, range=0..1)
# 1.
rectangle = Rectangle(Plane=xy_plane, XSize=size, YSize=size, Radius=0)  # -> Rectangle, Length

# ----
# 5.
# 1.
# 5.
# 7.
# 6.
gap = Slider(0.005, range=0..0.01)
# 4.
addition = Addition(A=size, B=gap)
# 12.
rectangle_2 = Rectangle(Plane=PlaneXY(0.2552584096, 0.00593429807, 0.125), XSize=addition, YSize=addition, Radius=0)  # -> Rectangle, Length

x_count = Slider(9, range=0..10)
y_count = Slider(15, range=0..100)
# 4.
rectangular_array = RectangularArray(Geometry=rectangle.Rectangle, Cell=rectangle_2.Rectangle, XCount=x_count, YCount=y_count)  # -> Geometry, Transform

# ----
# 4.
area = Area(Geometry=rectangular_array.Geometry)  # -> Area, Centroid
deconstruct = Deconstruct(Point=area.Centroid)  # -> XComponent, YComponent, ZComponent

# ----
# CALCULATES RANDOM ROTATION FROM -Y TO Y
negative = Negative(Value=deconstruct.YComponent)
# 5.
construct_domain = ConstructDomain(DomainStart=negative, DomainEnd=deconstruct.YComponent)
seed = Slider(9, range=0..10)
list_length = ListLength(List=area.Centroid)
# 8.
# 10.
random = Random(Range=Domain(0, 1000), Number=list_length, Seed=seed, Integers=True)
# 6.
random_2 = Random(Range=construct_domain, Number=1, Seed=random)  # -> flatten(Random)
# 9.
multiplication = Multiplication(A=random_2, B=Slider(100, range=0..500))

# ----
# Option A.
panel = Panel("CALCULATES RANDOM TRANSLATION")
# 11.
# 10.
# Option B.
# 8.
# 10.
# a) Load the Image
# b) Set Domains 0 To 1
# c) Select the brightness
panel_2 = Panel("0")
# 9.
construct_domain_2 = ConstructDomain(DomainStart=panel_2, DomainEnd=deconstruct.YComponent)
random_3 = Random(Range=construct_domain_2, Number=1, Seed=random)  # -> flatten(Random)
# 12.
multiplication_2 = Multiplication(A=random_3, B=Slider(0.11, range=0..1))

# ----
# 7.
panel_3 = Panel(random_2)

# ----
# 13.
panel_4 = Panel("ROTATION")
rotate = Rotate(Geometry=rectangular_array.Geometry, Angle=multiplication, Plane=area.Centroid)  # -> Geometry, Transform

# ----
# 14.
unit_x = UnitX(Factor=multiplication_2)
panel_5 = Panel("TRANSLATION -> X")
move = Move(Geometry=rotate.Geometry, Motion=unit_x)  # -> Geometry, Transform

# ----
# 15.
negative_2 = Negative(Value=multiplication_2)
panel_6 = Panel("TRANSLATION -> - Y")
unit_y = UnitY(Factor=negative_2)
move_2 = Move(Geometry=move.Geometry, Motion=unit_y)  # -> Geometry, Transform

info = Info()  # -> info
#   port info: Environment info.
# ---------- info: Python ----------
"""
Displays information about the active COMPAS environment.
"""

import compas_bootstrapper
from ghpythonlib.componentbase import executingcomponent as component

import compas


class CompasInfo(component):
    def RunScript(self):
        self.Message = "COMPAS v{}".format(compas.__version__)
        info = "COMPAS Version: {}\nEnvironment: {}"
        return info.format(compas.__version__, compas_bootstrapper.ENVIRONMENT_NAME)
# ---------- end info ----------

# ----
# INVERSE KINEMATICS for a list of Planes
# it checks the furthest snd the closest plane to the robot base frame + (num_mid_planes) x random planes in between
number_slider = Slider(0, range=0..5)
ghpython_script = GhPythonScript(num_mid_planes=number_slider)  # -> planes_to_check; inputs planes: list of Plane, num_mid_planes: Int32
# ---------- ghpython_script: Python ----------
import Rhino.Geometry as rg
import random

planes_to_check = []
# Ensure the input list is valid
if not planes or len(planes) < 3:
    closest = None
    furthest = None
    random_planes = []
else:
    origin = rg.Point3d.Origin

    # Sort planes based on the distance from origin to the plane's origin
    planes_sorted = sorted(planes, key=lambda p: p.Origin.DistanceTo(origin))

    # Get closest and furthest
    closest = planes_sorted[0]
    furthest = planes_sorted[-1]

    # Select a random plane that is not the closest or furthest
    middle_planes = [p for p in planes if p != closest and p != furthest]
    
# If not enough middle planes, allow repetition or reduce number
    if len(middle_planes) >= num_mid_planes:
        random_planes = random.sample(middle_planes, num_mid_planes)
    elif len(middle_planes) > 0:
        num_mid_planes = len(middle_planes)
        random_planes = random.sample(middle_planes, k=num_mid_planes)
    else:
        # Fallback: pick from all if only 2 planes exist
        random_planes = random.choices(planes, k=num_mid_planes)

planes_to_check.append(furthest)
planes_to_check.append(closest)
planes_to_check.extend(random_planes)
# ---------- end ghpython_script ----------

# ----
# Load robot from ROS
# Change IP : when running ROS in an another machine (eg. Linux)
# Default   : when running a docker file
# Check Reachability on Key Planes
boolean_toggle = BooleanToggle(True)
compas_fab_ros_connect = COMPASFABROSConnect(connect=boolean_toggle)  # -> ros_client, is_connected; inputs port: Int32, connect: Boolean
#   port ip: The ip address ROS. Defaults to 127.0.0.1.
#   port port: The port of ROS. Defaults to 9090.
#   port connect: If True, connects to ROS. If False, disconnects from ROS. Defaults to False.
#   port ros_client: The ROS client.
#   port is_connected: True if connection established.
# ---------- compas_fab_ros_connect: Python ----------
"""
Connect or disconnect to ROS.

COMPAS FAB v1.1.0
"""

from compas_ghpython import create_id
from ghpythonlib.componentbase import executingcomponent as component
from scriptcontext import sticky as st

from compas_fab.backends import RosClient


class ROSConnect(component):
    def RunScript(self, ip, port, connect):
        ros_client = None

        ip = ip or "127.0.0.1"
        port = port or 9090

        key = create_id(self, "ros_client")
        ros_client = st.get(key, None)

        if ros_client:
            st[key].close()
        if connect:
            st[key] = RosClient(ip, port)
            st[key].run(5)

        ros_client = st.get(key, None)
        is_connected = ros_client.is_connected if ros_client else False
        return (ros_client, is_connected)
# ---------- end compas_fab_ros_connect ----------
compas_fab_ros_robot = COMPASFABROSRobot(ros_client=compas_fab_ros_connect.ros_client, load=Toggle(True))  # -> robot; inputs load: Boolean
#   port ros_client: The ROS client.
#   port load: If True, loads the robot from ROS. Defaults to False.
# ---------- compas_fab_ros_robot: Python ----------
"""
Load robot directly from ROS.

COMPAS FAB v1.1.0
"""

from compas.scene import SceneObject
from compas_ghpython import create_id
from ghpythonlib.componentbase import executingcomponent as component
from scriptcontext import sticky as st


class ROSRobot(component):
    def RunScript(self, ros_client, load):
        key = create_id(self, "robot")

        if ros_client and ros_client.is_connected and load:
            # Load URDF from ROS
            st[key] = ros_client.load_robot(load_geometry=True, precision=12)
            st[key].scene_object = SceneObject(item=st[key].model)

        robot = st.get(key, None)
        if robot:  # client sometimes need to be restarted, without needing to reload geometry
            robot.client = ros_client
        return robot
# ---------- end compas_fab_ros_robot ----------
info_2 = PythonScript(robot=compas_fab_ros_robot)  # -> out, main_group_name
# ---------- info_2: Python ----------
if robot:
    robot.info()
    main_group_name = robot.main_group_name
# ---------- end info_2 ----------
panel_7 = Panel(info_2.out)

# ----
# Dependencies
# compas 		2.1.0
# compas-fab 	1.0.2
# compas-robots	0.4.0
panel_8 = Panel(info)

# ----
# 1) Here we assign randomly one of the 3 colors that we have.
# 2) We separate the paths into "move" = travelling paths and "draw"
number_slider_2 = Slider(5, range=0..10)
# From Polylines to Planes
list_length_2 = ListLength(List=move_2.Geometry)
random_4 = Random(Range=Domain(0, 2), Number=list_length_2, Seed=number_slider_2)
round = Round(Number=random_4)  # -> Nearest, Floor, Ceiling
point_2 = Point([Point(0.3730176261, -0.05907134777, 0.1367669885), Point(0.4251434118, -0.05907134777, 0.1367669885), Point(0.3223798929, -0.05907134777, 0.1367669885)])
ghpython_script_2 = GhPythonScript(rectangles=move_2.Geometry, colors=round.Nearest, colorBuckets=point_2)  # -> out, paths; inputs rectangles: list of Rectangle3d, colors: list of Int32, colorBuckets: list of Point3d
# ---------- ghpython_script_2: Python ----------
from Rhino.Geometry import Rectangle3d
import Rhino.Geometry as rg
import ghpythonlib.treehelpers as th
import copy

paths =[] # a nested list of planes

y=0
for rect in rectangles:
    path =[]
    for i in range (4):
        plane = rg.Plane(rect.Corner(i),-rg.Vector3d.ZAxis)
        path.append(plane)
    path.append(rg.Plane(rect.Corner(0),-rg.Vector3d.ZAxis))
    action = ["draw", path, colors[y]]
    paths.append(action)
    
    move_path=[]
    safe_pt = rect.Corner(0)
#    move_path.append(rg.Plane(safe_pt,-rg.Vector3d.ZAxis))
    safe_pt.Z += 0.1
    move_path.append(rg.Plane(safe_pt,-rg.Vector3d.ZAxis))
    
        
    if y!= len(rectangles)-1:
        
        if y>0 and colors[y]!= colors[y+1]:
            pt_color = colorBuckets[colors[y+1]]
            safe_pt_color = copy.deepcopy(pt_color)
            safe_pt_color.Z += 0.1
            move_path.append(rg.Plane(safe_pt_color,-rg.Vector3d.ZAxis))
            move_path.append(rg.Plane(pt_color,-rg.Vector3d.ZAxis))
            move_path.append(rg.Plane(safe_pt_color,-rg.Vector3d.ZAxis))
#            y+=1
#            continue
            
        safe_pt = rectangles[y+1].Corner(0)
        safe_pt.Z += 0.1
        move_path.append(rg.Plane(safe_pt,-rg.Vector3d.ZAxis))
        
        action = ["move", move_path, -1]
        paths.append(action)
    y+=1

#paths = th.list_to_tree (paths)
# ---------- end ghpython_script_2 ----------

# ----
# INVERSE KINEMATICS for a list of Planes
# List of Planes
# !! Z axis of the Planes should point downwards !!
# 
# !!! It doesn't check for Collisions !!!
# 
# !!! This component has been modified to work for a list of Planes !!!
planes = Plane(Plane(origin=(0.3394226276, -0.005859596333, 0.272951012), x=(0.009750683885, 0.9999475632, 0.003129682769), y=(0.9999505439, -0.009756745988, 0.001927582456)))
compas_fab_inverse_kinematics = COMPASFABInverseKinematics(robot=compas_fab_ros_robot, planes=planes)  # -> configurations; inputs planes: list
#   port planes: The plane or frame to calculate the inverse kinematic for.
#   port start_configuration: If passed, calculates the inverse such that the joint positions differ the least from the start_configuration. Defaults to the zero configuration.
#   port group: The planning group used for calculation. Defaults to the robot's main planning group.
#   port configurations: The planning group's configuration.
# ---------- compas_fab_inverse_kinematics: Python ----------
"""
Calculate the robot's inverse kinematic for a given plane.

COMPAS FAB v1.0.2
"""

from compas_rhino.conversions import plane_to_compas_frame
from ghpythonlib.componentbase import executingcomponent as component



class MultipleInverseKinematics(component):
    def RunScript(self, robot, planes, start_configuration, group):
    
        configurations = []
        if robot and robot.client and robot.client.is_connected and planes:
            for plane in planes:
                frame = plane_to_compas_frame(plane)
                config = robot.inverse_kinematics(frame, start_configuration, group)
                configurations.append(config)
                start_configuration = config
            
        return configurations
# ---------- end compas_fab_inverse_kinematics ----------

panel_9 = Panel("Notes")

# ----
# Define 4 planes in the corners of the rectangles
ghpython_script_3 = GhPythonScript(rectangles=move_2.Geometry)  # -> out, flatten(planes); inputs rectangles: list of Rectangle3d
# ---------- ghpython_script_3: Python ----------
from Rhino.Geometry import Rectangle3d
import Rhino.Geometry as rg
import ghpythonlib.treehelpers as th

planes =[] # a nested list of planes

for rect in rectangles:
    path =[]
    for i in range (4):
        plane = rg.Plane(rect.Corner(i),-rg.Vector3d.ZAxis)
        path.append(plane)
    path.append(rg.Plane(rect.Corner(0),-rg.Vector3d.ZAxis))
    planes.append(path)

planes = th.list_to_tree (planes)
# ---------- end ghpython_script_3 ----------

# ----
# Visualization of Robot's Movements
# Slide to visualize the trajectory
number_slider_3 = Slider(0, range=0..1)

# ----
# Specify your tool and which part of it do you want to reach the designed planes
plane = Plane(PlaneXY(0, 0, 0.09175922329))
# Visualization of Toolpath (without Robot)
# 1)
geometry = Geometry(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)

# ----
# Slide to visualize the trajectory
number_slider_4 = Slider(0, range=0..1)

# ----
# Slide to visualize the trajectory
number_slider_5 = Slider(0, range=0..0.125)

value_list = ValueList({"0. current config": 0, "1. Inverse Kinematic Configs": 1, "2. Forward Kinematic config": 2, "3. Trajectory": 3, "4. List of Configurations": 4}, selected="1. Inverse Kinematic Configs")
stream_filter = StreamFilter(Gate=value_list, Stream1=compas_fab_inverse_kinematics)

# ----
# With travelling paths and multiple colors
number_slider_6 = Slider(4, range=0..10)
ghpython_script_4 = GhPythonScript(tool=geometry, tcf_plane=plane, planes=ghpython_script_2.paths, i=number_slider_5, thickness=number_slider_6)  # -> oriented_mesh, polylines, all_pts; inputs tool: Mesh, tcf_plane: Plane, planes: list, thickness: Int32
# ---------- ghpython_script_4: Python ----------
from ghpythonlib.componentbase import executingcomponent as component
import Grasshopper, GhPython
import System
import Rhino.Geometry as rg
import rhinoscriptsyntax as rs

class VisualizePath(component):
    def RunScript(self, tool, tcf_plane, paths, i, thickness):

        self.t = max(1, int(thickness) if thickness is not None else 2)
        self.lines = []
        polylines = []
        all_pts=[]

        # Colors
        draw_colors = [ System.Drawing.Color.DarkOliveGreen, System.Drawing.Color.DarkOrange,System.Drawing.Color.DarkBlue]
        move_color = System.Drawing.Color.Gray

        # Safety checks
        if not tool or tcf_plane is None or paths is None or i is None:
            return [], None

        # Validate and prepare groups
        groups = []  #  (action, planes_list)

        try:
            for entry in paths:
                if not isinstance(entry, (list, tuple)) or len(entry) != 3:
                    continue
                action, plist, asign_color = entry[0], entry[1], draw_colors[entry[2]]
                
                action_str = str(action).strip().lower()
                if action_str not in ("draw", "move"):
                    # Unknown action ---->>> treat as travel
                    action_str = "move"
                # Ensure planes list
                if plist is None:
                    plist = []
                groups.append((action_str, list(plist), asign_color))
        except:
            return [], None
            
        group_ranges = []  
        total_count = 0
        for action, plist, asign_color in groups:
            n = len(plist)
            if n <= 0:
                continue
            start = total_count
            end = total_count + n - 1
            group_ranges.append((action, start, end, plist, asign_color))
            total_count += n

        if total_count == 0:
            return [], None

        # Clamp and map slider i -> global index across all planes
        i = max(0.0, min(1.0, float(i)))
        global_index = int(round(i * (total_count - 1)))

        # Determine target plane at global_index
        target_plane = None
        for action, start, end, plist, asign_color in group_ranges:
            if start <= global_index <= end:
                local_idx = global_index - start
                target_plane = plist[local_idx]
                break

        if target_plane is None:
            return [], None
        
        # Build colored polylines up to the current index, per group
        for action, start, end, plist, asign_color in group_ranges:
            if global_index < start:
                continue

            upto = min(global_index, end)
            take_count = (upto - start) + 1
            pts = [p.Origin for p in plist[:take_count]] if take_count > 0 else []
            all_pts.extend(pts)
            if len(pts) >= 2:
                plc = rg.Polyline(pts).ToPolylineCurve()
                polylines.append(plc)
                color = asign_color if action == "draw" else move_color
                self.lines.append((plc, color, action))

        # Orient the mesh to the target plane
        try:
            xform = rg.Transform.PlaneToPlane(tcf_plane, target_plane)
            oriented_mesh = tool.DuplicateMesh()
            oriented_mesh.Transform(xform)
        except:
            oriented_mesh = None

        return oriented_mesh, polylines, all_pts

    def DrawViewportWires(self, arg):
        if self.lines:
            for crv, color, action in self.lines:
                if action=="draw":
                    arg.Display.DrawCurve(crv, color, self.t)
                else:
                    arg.Display.DrawCurve(crv, color, self.t/2)
# ---------- end ghpython_script_4 ----------

# ----
# Without travelling paths and 1 color
number_slider_7 = Slider(4, range=0..10)
ghpython_script_5 = GhPythonScript(tool=geometry, tcf_plane=plane, planes=ghpython_script_3.planes, i=number_slider_4, thickness=number_slider_7)  # -> oriented_mesh, polylines; inputs tool: Mesh, tcf_plane: Plane, planes: list of Plane, thickness: Int32
# ---------- ghpython_script_5: Python ----------
from ghpythonlib.componentbase import executingcomponent as component
import Grasshopper, GhPython
import System
import Rhino.Geometry as rg
import rhinoscriptsyntax as rs

class VisualizePath(component):
    def RunScript(self, tool, tcf_plane, planes,i, thickness):
        self.t = thickness
        self.lines=[]
        polylines=[]
        color = System.Drawing.Color.DarkBlue
        
        # Safety checks
        if not planes or not tool or i is None or i==0.0:
            oriented_mesh = None
            polyline = None
        else:
            count = len(planes)
            
            # Clamp slider to [0.0, 1.0]
            i = max(0.0, min(1.0, i))
        
            # Remap slider to index
            index = int(i * (count - 1))
        
            # Get the target plane
            target_plane = planes[index]
        
            # Build polyline from plane origins up to and including the index
            poly_points = [p.Origin for p in planes[:index + 1]]
            polyline = rg.Polyline(poly_points).ToPolylineCurve()
        
            # Orient the tool
            xform = rg.Transform.PlaneToPlane(tcf_plane, target_plane)
        
            # Duplicate mesh and transform it
            oriented_mesh = tool.DuplicateMesh()
            oriented_mesh.Transform(xform)
            polylines.append(polyline)
            if polyline:
                self.lines.append((polyline, color))
        return polylines, oriented_mesh

    def DrawViewportWires(self, arg):
        if len(self.lines)!=0:
            for line, color in self.lines:
                arg.Display.DrawCurve(line, color, self.t)
# ---------- end ghpython_script_5 ----------

boolean_toggle_2 = BooleanToggle(False)
ghpython_script_6 = GhPythonScript(robot=compas_fab_ros_robot, selected=stream_filter, i=number_slider_3)  # -> config; inputs selected: list
# ---------- ghpython_script_6: Python ----------
import ghpythonlib.components as ghcomp
import compas_fab
from compas_fab.robots.robot import Configuration

def remap(value, source_min, source_max, target_min, target_max):

    normalized_value = (value - source_min) / (source_max - source_min)
    
    remapped_value = target_min + normalized_value * (target_max - target_min)
    
    return remapped_value

def trajectory_points_to_configs(trajectory_points):
    configs = [] 
    for trajectory_point in trajectory_points:
        joint_values = list(trajectory_point.values())
        config = Configuration(joint_values, [0,0,0,0,0,0])
        configs.append(config)
    return configs

if isinstance(selected, list) and all(isinstance(t, compas_fab.robots.trajectory.JointTrajectory) for t in selected):
        # Flatten all trajectory points from all JointTrajectory objects
        all_points = []
        for traj in selected:
            all_points.extend(traj.points)
        print len (all_points)
        # Convert to configurations
        configs = trajectory_points_to_configs(all_points)

        # Remap index
        index = int(remap(i, 0.001, 1.00, 0, len(configs) - 1))
        index = min(max(0, index), len(configs) - 1)
        result = configs[index]
elif isinstance(selected,list ) and all(isinstance(c, Configuration) for c in selected):
    
    index = int(remap(i, 0.001, 1.00, 0, len(selected) - 1))
    index = min(max(0, index), len(selected) - 1)
    result = selected[index]
else:
    result = None  


config = result
# ---------- end ghpython_script_6 ----------
compas_fab_robot_visualize = COMPASFABRobotVisualize(
    robot=compas_fab_ros_robot,
    configuration=ghpython_script_6,
    show_collision=boolean_toggle_2,
    show_cm=boolean_toggle_2,
    show_acm=boolean_toggle_2)  # -> visual, collision, collision_meshes, attached_meshes, frames, base_frame, ee_frame; inputs show_visual: Boolean, show_collision: Boolean, show_frames: Boolean, show_base_frame: Boolean, show_end_effector_frame: Boolean, show_cm: Boolean, show_acm: Boolean
#   port group: The planning group used for end-effector and base visualization.
#   port configuration: The robot's full configuration.
#   port show_visual: Whether or not to show the robot's visual meshes.
#   port show_collision: Whether or not to show the robot's collision meshes.
#   port show_frames: Whether or not to show the robot's joint frames.
#   port show_base_frame: Whether or not to show the robot's base frame.
#   port show_end_effector_frame: Whether or not to show the robot's end-effector frame.
#   port show_cm: Whether or not to show the collision meshes (if any).
#   port show_acm: Whether or not to show the attached collision meshes (if any).
#   port visual: Rhino meshes of the robot's visual geometry (if any).
#   port collision: Rhino meshes of the robot's collision geometry (if any).
#   port collision_meshes: Rhino meshes of the scene's collision meshes (if any).
#   port attached_meshes: Rhino meshes of the scene's attached collision meshes (if any).
#   port frames: The robot's joint frames as Rhino planes (if any).
#   port base_frame: The robot's base frame as a Rhino plane (if any).
#   port ee_frame: The robot's end-effector frame as a Rhino plane (if any).
# ---------- compas_fab_robot_visualize: Python ----------
"""
Visualizes the robot.

COMPAS FAB v1.0.2
"""

import time

from compas.geometry import Frame
from compas.geometry import Transformation
from compas.scene import SceneObject
from compas_ghpython import create_id
from compas_rhino.conversions import frame_to_rhino_plane
from ghpythonlib.componentbase import executingcomponent as component
from scriptcontext import sticky as st

from compas_fab.backends import BackendFeatureNotSupportedError
from compas_fab.robots import PlanningScene


class RobotVisualize(component):
    def RunScript(
        self,
        robot,
        group,
        configuration,
        show_visual,
        show_collision,
        show_frames,
        show_base_frame,
        show_end_effector_frame,
        show_cm,
        show_acm,
    ):
        visual = None
        collision = None
        collision_meshes = None
        attached_meshes = None
        frames = None
        base_frame = None
        ee_frame = None

        if robot:
            show_visual = True if show_visual is None else show_visual
            show_cm = True if show_cm is None else show_cm
            show_acm = True if show_acm is None else show_acm
            configuration = configuration or robot.zero_configuration()

            robot.update(configuration, visual=show_visual, collision=show_collision)
            compas_frames = robot.transformed_frames(configuration, group)

            if show_visual:
                visual = robot.scene_object.draw_visual()

            if show_collision:
                collision = robot.scene_object.draw_collision()

            if show_base_frame:
                base_compas_frame = compas_frames[0]
                base_frame = frame_to_rhino_plane(base_compas_frame)

            if show_end_effector_frame:
                options = dict(solver="model")
                if robot.attached_tool:
                    options["link"] = robot.attached_tool.connected_to

                ee_compas_frame = robot.forward_kinematics(configuration, group, options=options)
                ee_frame = frame_to_rhino_plane(ee_compas_frame)

            if show_frames:
                frames = []
                for compas_frame in compas_frames[1:]:
                    frame = frame_to_rhino_plane(compas_frame)
                    frames.append(frame)

            cached_scene_key = create_id(self, "cached_scene")

            if show_cm or show_acm:
                cached_scene = st.get(cached_scene_key)
                if not cached_scene:
                    cached_scene = {"time": 0}

                # expire cache if the component has not been executed in the last 2 seconds
                # this allows to slide through a list of configurations
                # without triggering refreshes of the scene in the middle of it
                if time.time() - cached_scene["time"] > 2:
                    update_scene = True
                else:
                    update_scene = False

                if update_scene:
                    scene = PlanningScene(robot)
                    try:
                        scene = robot.client.get_planning_scene()
                    except BackendFeatureNotSupportedError:
                        print(
                            "The selected backend does not support collision meshes. If you need collision mesh support, use a different backend."
                        )
                        scene = None
                        show_cm = False
                        show_acm = False

                if update_scene and show_cm:
                    collision_meshes = []

                    for co in scene.world.collision_objects:
                        header = co.header
                        frame_id = header.frame_id
                        cms = co.to_collision_meshes()

                        for cm in cms:
                            if cm.frame != Frame.worldXY():
                                t = Transformation.from_frame(cm.frame)
                                mesh = cm.mesh.transformed(t)
                            else:
                                mesh = cm.mesh
                            print type(mesh)
                            collision_meshes.extend(SceneObject(mesh).draw())

                        cached_scene["cm"] = collision_meshes

                collision_meshes = cached_scene.get("cm", [])

                if update_scene and show_acm:
                    attached_meshes = []

                    for aco in scene.robot_state.attached_collision_objects:
                        for acm in aco.to_attached_collision_meshes():
                            frame_id = aco.object["header"]["frame_id"]
                            frame = robot.forward_kinematics(configuration, options=dict(link=frame_id))
                            t = Transformation.from_frame(frame)

                            # Local CM frame
                            if acm.collision_mesh.frame and acm.collision_mesh.frame != Frame.worldXY():
                                t = t * Transformation.from_frame(acm.collision_mesh.frame)

                            mesh = acm.collision_mesh.mesh.transformed(t)
    
                            attached_meshes.extend(SceneObject(mesh).draw())

                    cached_scene["acm"] = attached_meshes

                attached_meshes = cached_scene.get("acm", [])

                cached_scene["time"] = time.time()
                st[cached_scene_key] = cached_scene

        return (
            visual,
            collision,
            collision_meshes,
            attached_meshes,
            frames,
            base_frame,
            ee_frame,
        )
# ---------- end compas_fab_robot_visualize ----------
