# Grasshopper definition CompleteFile.ghx (Grasshopper 1.0.7)
# plug-ins: Bifocals

# 7.
# 5.
# 6.
# 2.
# 1.
# 4.
# 8.
# 3.
# 13.
# 14.
# 9.
# 5.
# 10.
# 12.
# 11.
# a) Right Click
# b) Set One Plane
button = Button()
info = Info()  # -> info
#   port info: Environment info.
# ---------- info: Python ----------
"""
Displays information about the active COMPAS environment.
"""

import compas_bootstrapper
from ghpythonlib.componentbase import executingcomponent as component

import compas


class CompasInfo(component):
    def RunScript(self):
        self.Message = "COMPAS v{}".format(compas.__version__)
        info = "COMPAS Version: {}\nEnvironment: {}"
        return info.format(compas.__version__, compas_bootstrapper.ENVIRONMENT_NAME)
# ---------- end info ----------

number_slider = Slider(-204, range=-360..360)
number_slider_2 = Slider(-70, range=-360..360)
number_slider_3 = Slider(-110, range=-360..360)
number_slider_4 = Slider(-89, range=-360..360)
number_slider_5 = Slider(93, range=-360..360)
number_slider_6 = Slider(-17, range=-360..360)

# ----
# Simplified Brep
# Set Brep from Rhino
# Leave a 2mm gap from the ee_link's Frame
panel = Panel("b) Collision Mesh")
brep = Brep(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)
mesh_brep = MeshBrep(
    Brep=brep,
    Settings={GridMaxCount=0, GridMinCount=16, JaggedSeams=False, MaxEdgeLength=0, MinEdgeLength=0.0001, MinTolerance=0, Refine=True, RefineAngle=0, RelativeTolerance=0.65, SimplePlanes=True, Tolerance=0})

# ----
# !! Don't forget to internalize your Inputs from Rhino !!
panel_2 = Panel("c) Tool's Frame")
point = Point(Point(0, 0, 0.1212837318))
xy_plane = XYPlane(Origin=point)

# ----
# Dependencies
# compas 		2.1.0
# compas_rrc 	1.1.0
# compas-fab 	1.0.2
# compas-robots	0.4.0
panel_3 = Panel(info)

# ----
# 3D printed Part
# Set Brep from Rhino
brep_2 = Brep([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])

# ----
# Brush
# Set Mesh from Rhino
mesh_brush = Mesh([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])

panel_4 = Panel("a) Visual Mesh")
mesh_brep_2 = MeshBrep(
    Brep=brep_2,
    Settings={GridMaxCount=0, GridMinCount=16, JaggedSeams=False, MaxEdgeLength=0, MinEdgeLength=0.0001, MinTolerance=0, Refine=True, RefineAngle=0, RelativeTolerance=0.65, SimplePlanes=True, Tolerance=0})
mesh_join = MeshJoin(Meshes=[mesh_brush, mesh_brep_2])

boolean_toggle = BooleanToggle(True)  # disabled
boolean_toggle_2 = BooleanToggle(False)  # disabled
panel_5 = Panel("Steps !")
# Send to a config
button_2 = Button()
# Jump back
# to execution
# Double Click Me!
i_am_using = ValueList({"Robot LL": 0, "Robot RR": 1}, selected="Robot RR")
data = Data(i_am_using)

# ----
# ---------------  Set Parameters  ---------------
# Specify which robot you are using
# 2.
# 4.
# a) Right Click
# b) Set One Plane
robot_rr_ip = Panel("169.254.204.200")
# Double Click Me!
robot_ll_ip = Panel("192.168.10.10")
# ↓↓↓↓↓↓↓↓↓↓↓ UR RTDE - Send Robotic Comands ↓↓↓↓↓↓↓↓↓↓↓
# Only work when you are connected to a robot
panel_6 = Panel("a) Robot's IP Address")
stream_filter = StreamFilter(Gate=data, Stream0=robot_ll_ip, Stream1=robot_rr_ip)
panel_7 = Panel("b) Speed")
speed = Slider(1.25, range=0..5)
panel_8 = Panel("c)  Acceleration")
acceleration = Slider(0.1, range=0..3.14)
panel_9 = Panel("d) Blend Radius")
blend_radius = Slider(0.01, range=0..3.14)

panel_10 = Panel(stream_filter)
# ---------------  Actions  ---------------
toggle_freedrive = GhPythonScript(ip=panel_10, start_teach_mode=boolean_toggle, stop_teach_mode=boolean_toggle_2)  # -> a; disabled
# ---------- toggle_freedrive: Python ----------
import os
import math

from compas.rpc import Proxy
package_path = ghdoc.Path
path = os.path.abspath(os.path.join(package_path,"../robot"))

if start_teach_mode:   
    canvas = ghenv.Component.OnPingDocument()
#    path = os.path.abspath(os.path.dirname(canvas.FilePath))
    rtde = Proxy('fabrication', path=path)                         # stay in teach moded(freedrive) as long as this is True
    a = rtde.start_teach_mode(ip=ip)            # send message to robot
    ghenv.Component.Message = "Freedrive on"    # display message on GH component

if stop_teach_mode:   
    canvas = ghenv.Component.OnPingDocument()
    print (path)
    rtde = Proxy('fabrication', path=path)                          # stop teach mode if stop button pressed
    a = rtde.stop_teach_mode(ip=ip)             # send message to robot   
    ghenv.Component.Message = "Freedrive off"   # display message on GH component
# ---------- end toggle_freedrive ----------
move_to_config = GhPythonScript(speed=speed, accel=acceleration, send=button_2, ip=panel_10)  # -> a
# ---------- move_to_config: Python ----------
import os
import math

from compas.rpc import Proxy
package_path = ghdoc.Path

if send:
    if not config:
        ghenv.Component.Message = "No config to move to!"
    else:
        canvas = ghenv.Component.OnPingDocument()
        path = os.path.abspath(os.path.join(package_path,"../robot"))
        rtde = Proxy('fabrication', path=path)
        nowait = True
        a = rtde.move_to_joints(config, speed, accel, nowait, ip=ip)
        ghenv.Component.Message = "Sent config"
# ---------- end move_to_config ----------
panel_11 = Panel("Notes")

panel_12 = Panel("Attach Collision Meshes")

# ----
# Send to a plane
button_3 = Button()
geos = Geometry(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)
geos_2 = Geometry(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)
stream_filter_2 = StreamFilter(Gate=i_am_using, Stream0=geos, Stream1=geos_2)
move_to_target = GhPythonScript(speed=speed, accel=acceleration, send=button_3, ip=panel_10)  # -> a
# ---------- move_to_target: Python ----------
import os
import math
from compas.rpc import Proxy
from compas_rhino.conversions import plane_to_compas_frame

package_path = ghdoc.Path

if send:
    if not plane:
        ghenv.Component.Message = "No frame to move to!"
    else:
        canvas = ghenv.Component.OnPingDocument()
        path = os.path.abspath(os.path.join(package_path,"../robot"))
        rtde = Proxy('fabrication', path=path)
        frame = plane_to_compas_frame(plane)
        nowait = True
        a = rtde.move_to_target(frame, speed, accel, nowait, ip=ip)
        ghenv.Component.Message = "Sent frame"
# ---------- end move_to_target ----------

# ----
# Slide to visualize the trajectory
number_slider_7 = Slider(1, range=0..1)

in_seconds = Slider(2.2, range=0..10)
in_seconds_2 = Slider(2.2, range=0..10)
# Send to a plane
button_4 = Button()

# ----
# 2) Attach tools and Collision Meshes
panel_13 = Panel("Attach Tool")

# ----
# 1) Load robot from ROS
# Change IP : when running ROS in an another machine (eg. Linux)
# Default   : when running a docker file
boolean_toggle_3 = BooleanToggle(True)
compas_fab_ros_connect = COMPASFABROSConnect(connect=boolean_toggle_3)  # -> ros_client, is_connected; inputs port: Int32, connect: Boolean
#   port ip: The ip address ROS. Defaults to 127.0.0.1.
#   port port: The port of ROS. Defaults to 9090.
#   port connect: If True, connects to ROS. If False, disconnects from ROS. Defaults to False.
#   port ros_client: The ROS client.
#   port is_connected: True if connection established.
# ---------- compas_fab_ros_connect: Python ----------
"""
Connect or disconnect to ROS.

COMPAS FAB v1.1.0
"""

from compas_ghpython import create_id
from ghpythonlib.componentbase import executingcomponent as component
from scriptcontext import sticky as st

from compas_fab.backends import RosClient


class ROSConnect(component):
    def RunScript(self, ip, port, connect):
        ros_client = None

        ip = ip or "127.0.0.1"
        port = port or 9090

        key = create_id(self, "ros_client")
        ros_client = st.get(key, None)

        if ros_client:
            st[key].close()
        if connect:
            st[key] = RosClient(ip, port)
            st[key].run(5)

        ros_client = st.get(key, None)
        is_connected = ros_client.is_connected if ros_client else False
        return (ros_client, is_connected)
# ---------- end compas_fab_ros_connect ----------
compas_fab_ros_robot = COMPASFABROSRobot(ros_client=compas_fab_ros_connect.ros_client, load=Toggle(True))  # -> robot; inputs load: Boolean
#   port ros_client: The ROS client.
#   port load: If True, loads the robot from ROS. Defaults to False.
# ---------- compas_fab_ros_robot: Python ----------
"""
Load robot directly from ROS.

COMPAS FAB v1.1.0
"""

from compas.scene import SceneObject
from compas_ghpython import create_id
from ghpythonlib.componentbase import executingcomponent as component
from scriptcontext import sticky as st


class ROSRobot(component):
    def RunScript(self, ros_client, load):
        key = create_id(self, "robot")

        if ros_client and ros_client.is_connected and load:
            # Load URDF from ROS
            st[key] = ros_client.load_robot(load_geometry=True, precision=12)
            st[key].scene_object = SceneObject(item=st[key].model)

        robot = st.get(key, None)
        if robot:  # client sometimes need to be restarted, without needing to reload geometry
            robot.client = ros_client
        return robot
# ---------- end compas_fab_ros_robot ----------

tool = COMPASFABAttachedTool(robot=compas_fab_ros_robot, visual_mesh=mesh_join, collision_mesh=mesh_brep, tcf_plane=xy_plane)  # -> robot; inputs visual_mesh: Mesh, collision_mesh: Mesh
#   port visual_mesh: A visual mesh for the tool.
#   port collision_mesh: A collision mesh for the tool.
#   port tcf_plane: The frame of the tool in tool0 frame.
#   port group: The planning group to which the tool should be attached.
#   port connected_to: The link to which the tool should be connected to.
# ---------- tool: Python ----------
"""
Attach a tool to the robot.

COMPAS FAB v1.0.2
"""

from compas.geometry import Frame
from compas_rhino.conversions import mesh_to_compas
from compas_rhino.conversions import plane_to_compas_frame
from ghpythonlib.componentbase import executingcomponent as component

from compas_fab.robots import Tool


class AttachToolComponent(component):
    def RunScript(self, robot, visual_mesh, collision_mesh, tcf_plane, group, connected_to):
        if robot and robot.client and robot.client.is_connected and visual_mesh:
            if not collision_mesh:
                collision_mesh = visual_mesh

            c_visual_mesh = mesh_to_compas(visual_mesh)
            c_collision_mesh = mesh_to_compas(collision_mesh)

            if not tcf_plane:
                frame = Frame.worldXY()
            else:
                frame = plane_to_compas_frame(tcf_plane)
            tool = Tool(c_visual_mesh, frame, c_collision_mesh)

            robot.attach_tool(tool, group)

        return robot
# ---------- end tool ----------

# ----
# ↓↓↓ This is your complete Robot ↓↓↓
robot = Data(tool)
info_2 = PythonScript(robot=robot)  # -> out, main_group_name
# ---------- info_2: Python ----------
if robot:
    robot.info()
    main_group_name = robot.main_group_name
# ---------- end info_2 ----------
panel_14 = Panel(info_2.out)

# ----
# Get Current Config
get_config = GhPythonScript(robot=robot, send=button, ip=panel_10)  # -> config, frame_WCF
# ---------- get_config: Python ----------
import os
from scriptcontext import sticky as st
#sticky is a persistent dictionary which can save values and also be acessed by other GH components
#we use it here with a custom key to store values we read from the robot
from compas.rpc import Proxy
from compas.geometry import Frame
package_path = ghdoc.Path

config_key = 'config_{}'.format(str(ghenv.Component.InstanceGuid))
frame_key = 'frame_{}'.format(str(ghenv.Component.InstanceGuid))

if config_key not in st:
    st[config_key] = None

if frame_key not in st:
    st[frame_key] = None

if send:
    canvas = ghenv.Component.OnPingDocument()
    path = os.path.abspath(os.path.join(package_path,"../robot"))
    print (path)
    rtde = Proxy('fabrication', path=path)
    a = rtde.get_config(ip=ip)
    st[config_key] = rtde.get_config(ip=ip)
    st[frame_key] = robot.forward_kinematics(st[config_key], group, options=dict(solver='model'))
#    a = rtde.get_config(ip=ip)

config = st[config_key]
frame_RCF = st[frame_key]

#print "joint values: ", config.joint_values

#frame_WCF = frame_RCF.transformed(robot.transformation_BCF_WCF())
#print frame_RCF
# ---------- end get_config ----------

# ----
# Plan your trajectory
# Test for Robot LL
# Test for Robot RR
point_2 = Point([Point(0.4509854836, -0.1498950214, 0.1539997758), Point(0.3793329673, -0.05731061348, 0.1539997758), Point(0.4509854836, -0.01514946346, 0.1539997758), Point(0.3793329673, 0.03279850758, 0.1539997758)])
point_3 = Point([Point(-0.3215598354, 0.2093170206, 0.1283160574), Point(-0.3614441328, 0.1151619199, 0.1283160574), Point(-0.3199481222, 0.08579923537, 0.1283160574), Point(-0.2589458132, 0.05160060536, 0.1283160574)])
xy_plane_2 = XYPlane(Origin=point_3)
flip_plane = FlipPlane(Plane=xy_plane_2, ReverseX=False, ReverseY=False, SwapAxes=True)
compas_fab_plan_cartesian_motion = COMPASFABPlanCartesianMotion(robot=robot, planes=flip_plane, start_configuration=get_config.config, compute=Button())  # -> trajectory; inputs planes: list, attached_collision_meshes: list, path_constraints: list, compute: Boolean
#   port planes: The planes or frames through which the path is defined.
#   port start_configuration: The robot's full configuration, i.e. values for all configurable joints of the entire robot, at the starting position. Defaults to the all-zero configuration.
#   port group: The planning group used for calculation. Defaults to the robot's main planning group.
#   port attached_collision_meshes: A list of attached collision meshes to be included for planning.
#   port path_constraints: Optional constraints that can be imposed along the solution path. Note that path calculation won't work if the start_configuration violates these constraints. Defaults to None.
#   port max_step: The approximate distance between the calculated points. (Defined in the robot's units.) Defaults to 0.01.
#   port compute: If True, calculates a trajectory.
#   port trajectory: The calculated trajectory.
# ---------- compas_fab_plan_cartesian_motion: Python ----------
"""
Calculate a cartesian motion path (linear in tool space).

COMPAS FAB v1.1.0
"""

from compas_ghpython import create_id
from compas_rhino.conversions import plane_to_compas_frame
from ghpythonlib.componentbase import executingcomponent as component
from scriptcontext import sticky as st


class PlanCartesianMotion(component):
    def RunScript(
        self, robot, planes, start_configuration, group, attached_collision_meshes, path_constraints, max_step, compute
    ):
        key = create_id(self, "trajectory")

        max_step = float(max_step) if max_step else 0.01
        path_constraints = list(path_constraints) if path_constraints else None
        attached_collision_meshes = list(attached_collision_meshes) if attached_collision_meshes else None

        if robot and robot.client and robot.client.is_connected and start_configuration and planes and compute:
            frames = [plane_to_compas_frame(plane) for plane in planes]
            st[key] = robot.plan_cartesian_motion(
                frames,
                start_configuration=start_configuration,
                group=group,
                options=dict(
                    max_step=max_step,
                    path_constraints=path_constraints,
                    attached_collision_meshes=attached_collision_meshes,
                ),
            )

        trajectory = st.get(key, None)
        return trajectory
# ---------- end compas_fab_plan_cartesian_motion ----------

# ----
# FORWARD KINEMATICS
forward_kinematics = PythonScript(
    robot=robot,
    shoulder_pan=number_slider,
    shoulder_lift=number_slider_2,
    elbow=number_slider_3,
    wrist_1=number_slider_4,
    wrist_2=number_slider_5,
    wrist_3=number_slider_6)  # -> full_configuration
# ---------- forward_kinematics: Python ----------
import math
import Grasshopper
from compas_fab.robots.robot import Joint
from compas_fab.robots.robot import Configuration

if robot:
    joints = robot.get_configurable_joints()
    joint_types = [joint.type for joint in joints]
    joint_names = [joint.name for joint in joints]
    
    joint_positions = [ 
                        math.radians(shoulder_pan), math.radians(shoulder_lift), 
                        math.radians(elbow), math.radians(wrist_1), 
                        math.radians(wrist_2), math.radians(wrist_3)]
    
    full_configuration = Configuration(joint_positions, joint_types, joint_names)
    
print(full_configuration)
# ---------- end forward_kinematics ----------
compas_fab_forward_kinematics = COMPASFABForwardKinematics(robot=robot, config=forward_kinematics)  # -> frame; inputs use_only_model: Boolean
#   port config: The configuration to calculate the forward kinematics for.
#   port group: The planning group used for calculation. Defaults to the robot's main planning group.
#   port link: The link name to calculate forward kinematics for. Defaults to the robot's end effector.
#   port use_only_model: If True, use only the robot model instead of the connected backend to calculate FK.
#   port frame: The resulting frame.
# ---------- compas_fab_forward_kinematics: Python ----------
"""
Calculate the robot's forward kinematic for a given configuration.

COMPAS FAB v1.1.0
"""

from ghpythonlib.componentbase import executingcomponent as component


class ForwardKinematics(component):
    def RunScript(self, robot, config, group, link, use_only_model):
        frame = None
        if robot and config:
            options = {}
            if link:
                options["link"] = link
            if use_only_model:
                options["solver"] = "model"
            frame = robot.forward_kinematics(config, group, options=options)
        return frame
# ---------- end compas_fab_forward_kinematics ----------
ghpython_script = GhPythonScript(frames=compas_fab_forward_kinematics)  # -> planes; inputs frames: list
# ---------- ghpython_script: Python ----------
from compas_rhino.conversions import frame_to_rhino

planes =[]

for frame in frames: 
    planes.append(frame_to_rhino(frame))
# ---------- end ghpython_script ----------

geos_3 = Geometry(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)
mesh = Mesh([geos_3, stream_filter_2])
attach_cm = GhPythonScript(robot=robot, meshes=mesh)  # inputs meshes: list of Mesh
# ---------- attach_cm: Python ----------
from compas_fab.robots import PlanningScene
from compas_fab.robots import CollisionMesh
from compas_rhino.conversions import mesh_to_compas

if robot:
    scene = PlanningScene(robot)
    scene.remove_collision_mesh("setup")
    i=0
    for m in meshes:
        mesh = mesh_to_compas(m)
        cm = CollisionMesh(mesh, "setup"+ str(i))
        scene.add_collision_mesh(cm)
        i+=1
# ---------- end attach_cm ----------

# ----
# Check Reachability on Key Planes
# INVERSE KINEMATICS for a list of Planes
# List of Planes
# it checks the furthest snd the closest plane to the robot base frame + (num_mid_planes) x random planes in between
# !! Z axis of the Planes should point downwards !!
# 
# !!! It doesn't check for Collisions !!!
# 
# !!! This component has been modified to work for a list of Planes !!!
number_slider_8 = Slider(2, range=0..5)
ghpython_script_2 = GhPythonScript(num_mid_planes=number_slider_8)  # -> planes_to_check; inputs planes: list of Plane, num_mid_planes: Int32
# ---------- ghpython_script_2: Python ----------
import Rhino.Geometry as rg
import random

planes_to_check = []
# Ensure the input list is valid
if not planes or len(planes) < 3:
    closest = None
    furthest = None
    random_planes = []
else:
    origin = rg.Point3d.Origin

    # Sort planes based on the distance from origin to the plane's origin
    planes_sorted = sorted(planes, key=lambda p: p.Origin.DistanceTo(origin))

    # Get closest and furthest
    closest = planes_sorted[0]
    furthest = planes_sorted[-1]

    # Select a random plane that is not the closest or furthest
    middle_planes = [p for p in planes if p != closest and p != furthest]
    
# If not enough middle planes, allow repetition or reduce number
    if len(middle_planes) >= num_mid_planes:
        random_planes = random.sample(middle_planes, num_mid_planes)
    elif len(middle_planes) > 0:
        num_mid_planes = len(middle_planes)
        random_planes = random.sample(middle_planes, k=num_mid_planes)
    else:
        # Fallback: pick from all if only 2 planes exist
        random_planes = random.choices(planes, k=num_mid_planes)

planes_to_check.append(closest)
planes_to_check.extend(random_planes)
planes_to_check.append(furthest)
# ---------- end ghpython_script_2 ----------
planes = Plane(ghpython_script_2)
compas_fab_inverse_kinematics = COMPASFABInverseKinematics(robot=compas_fab_ros_robot, planes=planes, compute=Button())  # -> configurations; inputs planes: list
#   port planes: The plane or frame to calculate the inverse kinematic for.
#   port start_configuration: If passed, calculates the inverse such that the joint positions differ the least from the start_configuration. Defaults to the zero configuration.
#   port group: The planning group used for calculation. Defaults to the robot's main planning group.
#   port configurations: The planning group's configuration.
# ---------- compas_fab_inverse_kinematics: Python ----------
"""
Calculate the robot's inverse kinematic for a given plane.

COMPAS FAB v1.0.2
"""

from compas_rhino.conversions import plane_to_compas_frame
from ghpythonlib.componentbase import executingcomponent as component



class MultipleInverseKinematics(component):
    def RunScript(self, robot, planes, start_configuration, group, compute):
    
        configurations = []
        if robot and robot.client and robot.client.is_connected and planes:
            for plane in planes:
                frame = plane_to_compas_frame(plane)
                config = robot.inverse_kinematics(frame, start_configuration, group)
                configurations.append(config)
                start_configuration = config
            
        return configurations
# ---------- end compas_fab_inverse_kinematics ----------

info_3 = PythonScript(robot=robot)  # -> out, main_group_name; same code as info_2
panel_15 = Panel(info_3.out)

value_list = ValueList({"0. current config": 0, "1. Inverse Kinematic Configs": 1, "2. Forward Kinematic config": 2, "3. Trajectory": 3, "4. List of Configurations": 4}, selected="3. Trajectory")
stream_filter_3 = StreamFilter(
    Gate=value_list,
    Stream0=get_config.config,
    Stream1=compas_fab_inverse_kinematics,
    Stream2=forward_kinematics,
    Stream3=compas_fab_plan_cartesian_motion)

pick_and_place = GhPythonScript(
    trajectory=compas_fab_plan_cartesian_motion,
    speed=speed,
    accel=acceleration,
    radius=blend_radius,
    stop_before=in_seconds,
    stop_after=in_seconds_2,
    send=button_4,
    ip=panel_10)
# ---------- pick_and_place: Python ----------
import os
import math
import time
from scriptcontext import sticky as st
import Grasshopper.Kernel as gh
from compas.rpc import Proxy
from compas.geometry import Translation, Vector, Transformation, Frame
import ghpythonlib.treehelpers as th

vaccum_io = 5
package_path = ghdoc.Path
#send_trajectory_key = 'send_trajectory_key' + send_topic_name

#print send
#print st[send_trajectory_key]

#Check if value is true and sticky of the value has been updated
if send:
    if not trajectory: #if configs provided, then display message
        ghenv.Component.Message = "No trajectory to move to!"

    else:
        canvas = ghenv.Component.OnPingDocument()
        path = os.path.abspath(os.path.join(package_path,"../robot"))
        print path
        rtde = Proxy('fabrication', path=path)
        rtde.send_trajectory_radius(trajectory, speed, accel, radius, stop_before, stop_after, ip)
        
        ghenv.Component.Message = "Sent frames" #display message on component
#        a = st['send_trajectory_key']

else:
            ghenv.Component.Message = "Send has not been received yet" #display message on component = "Send has not been received yet"
# ---------- end pick_and_place ----------

# ----
# Visualization of Robot's Movements
boolean_toggle_4 = BooleanToggle(False)
ghpython_script_3 = GhPythonScript(robot=robot, selected=stream_filter_3, i=number_slider_7)  # -> config; inputs selected: list
# ---------- ghpython_script_3: Python ----------
import ghpythonlib.components as ghcomp
import compas_fab
from compas_fab.robots.robot import Configuration

def remap(value, source_min, source_max, target_min, target_max):

    normalized_value = (value - source_min) / (source_max - source_min)
    
    remapped_value = target_min + normalized_value * (target_max - target_min)
    
    return remapped_value

def trajectory_points_to_configs(trajectory_points):
    configs = [] 
    for trajectory_point in trajectory_points:
        joint_values = list(trajectory_point.values())
        config = Configuration(joint_values, [0,0,0,0,0,0])
        configs.append(config)
    return configs

if isinstance(selected, list) and all(isinstance(t, compas_fab.robots.trajectory.JointTrajectory) for t in selected):
        # Flatten all trajectory points from all JointTrajectory objects
        all_points = []
        for traj in selected:
            all_points.extend(traj.points)
        print len (all_points)
        # Convert to configurations
        configs = trajectory_points_to_configs(all_points)

        # Remap index
        index = int(remap(i, 0.001, 1.00, 0, len(configs) - 1))
        index = min(max(0, index), len(configs) - 1)
        result = configs[index]
elif isinstance(selected,list ) and all(isinstance(c, Configuration) for c in selected):
    
    index = int(remap(i, 0.001, 1.00, 0, len(selected) - 1))
    index = min(max(0, index), len(selected) - 1)
    result = selected[index]
else:
    result = None  


config = result
# ---------- end ghpython_script_3 ----------
compas_fab_robot_visualize = COMPASFABRobotVisualize(
    robot=robot,
    configuration=ghpython_script_3,
    show_collision=boolean_toggle_4,
    show_cm=boolean_toggle_4,
    show_acm=boolean_toggle_4)  # -> visual, collision, collision_meshes, attached_meshes, frames, base_frame, ee_frame; inputs show_visual: Boolean, show_collision: Boolean, show_frames: Boolean, show_base_frame: Boolean, show_end_effector_frame: Boolean, show_cm: Boolean, show_acm: Boolean
#   port group: The planning group used for end-effector and base visualization.
#   port configuration: The robot's full configuration.
#   port show_visual: Whether or not to show the robot's visual meshes.
#   port show_collision: Whether or not to show the robot's collision meshes.
#   port show_frames: Whether or not to show the robot's joint frames.
#   port show_base_frame: Whether or not to show the robot's base frame.
#   port show_end_effector_frame: Whether or not to show the robot's end-effector frame.
#   port show_cm: Whether or not to show the collision meshes (if any).
#   port show_acm: Whether or not to show the attached collision meshes (if any).
#   port visual: Rhino meshes of the robot's visual geometry (if any).
#   port collision: Rhino meshes of the robot's collision geometry (if any).
#   port collision_meshes: Rhino meshes of the scene's collision meshes (if any).
#   port attached_meshes: Rhino meshes of the scene's attached collision meshes (if any).
#   port frames: The robot's joint frames as Rhino planes (if any).
#   port base_frame: The robot's base frame as a Rhino plane (if any).
#   port ee_frame: The robot's end-effector frame as a Rhino plane (if any).
# ---------- compas_fab_robot_visualize: Python ----------
"""
Visualizes the robot.

COMPAS FAB v1.0.2
"""

import time

from compas.geometry import Frame
from compas.geometry import Transformation
from compas.scene import SceneObject
from compas_ghpython import create_id
from compas_rhino.conversions import frame_to_rhino_plane
from ghpythonlib.componentbase import executingcomponent as component
from scriptcontext import sticky as st

from compas_fab.backends import BackendFeatureNotSupportedError
from compas_fab.robots import PlanningScene


class RobotVisualize(component):
    def RunScript(
        self,
        robot,
        group,
        configuration,
        show_visual,
        show_collision,
        show_frames,
        show_base_frame,
        show_end_effector_frame,
        show_cm,
        show_acm,
    ):
        visual = None
        collision = None
        collision_meshes = None
        attached_meshes = None
        frames = None
        base_frame = None
        ee_frame = None

        if robot:
            show_visual = True if show_visual is None else show_visual
            show_cm = True if show_cm is None else show_cm
            show_acm = True if show_acm is None else show_acm
            configuration = configuration or robot.zero_configuration()

            robot.update(configuration, visual=show_visual, collision=show_collision)
            compas_frames = robot.transformed_frames(configuration, group)

            if show_visual:
                visual = robot.scene_object.draw_visual()

            if show_collision:
                collision = robot.scene_object.draw_collision()

            if show_base_frame:
                base_compas_frame = compas_frames[0]
                base_frame = frame_to_rhino_plane(base_compas_frame)

            if show_end_effector_frame:
                options = dict(solver="model")
                if robot.attached_tool:
                    options["link"] = robot.attached_tool.connected_to

                ee_compas_frame = robot.forward_kinematics(configuration, group, options=options)
                ee_frame = frame_to_rhino_plane(ee_compas_frame)

            if show_frames:
                frames = []
                for compas_frame in compas_frames[1:]:
                    frame = frame_to_rhino_plane(compas_frame)
                    frames.append(frame)

            cached_scene_key = create_id(self, "cached_scene")

            if show_cm or show_acm:
                cached_scene = st.get(cached_scene_key)
                if not cached_scene:
                    cached_scene = {"time": 0}

                # expire cache if the component has not been executed in the last 2 seconds
                # this allows to slide through a list of configurations
                # without triggering refreshes of the scene in the middle of it
                if time.time() - cached_scene["time"] > 2:
                    update_scene = True
                else:
                    update_scene = False

                if update_scene:
                    scene = PlanningScene(robot)
                    try:
                        scene = robot.client.get_planning_scene()
                    except BackendFeatureNotSupportedError:
                        print(
                            "The selected backend does not support collision meshes. If you need collision mesh support, use a different backend."
                        )
                        scene = None
                        show_cm = False
                        show_acm = False

                if update_scene and show_cm:
                    collision_meshes = []

                    for co in scene.world.collision_objects:
                        header = co.header
                        frame_id = header.frame_id
                        cms = co.to_collision_meshes()

                        for cm in cms:
                            if cm.frame != Frame.worldXY():
                                t = Transformation.from_frame(cm.frame)
                                mesh = cm.mesh.transformed(t)
                            else:
                                mesh = cm.mesh
                            print type(mesh)
                            collision_meshes.extend(SceneObject(mesh).draw())

                        cached_scene["cm"] = collision_meshes

                collision_meshes = cached_scene.get("cm", [])

                if update_scene and show_acm:
                    attached_meshes = []

                    for aco in scene.robot_state.attached_collision_objects:
                        for acm in aco.to_attached_collision_meshes():
                            frame_id = aco.object["header"]["frame_id"]
                            frame = robot.forward_kinematics(configuration, options=dict(link=frame_id))
                            t = Transformation.from_frame(frame)

                            # Local CM frame
                            if acm.collision_mesh.frame and acm.collision_mesh.frame != Frame.worldXY():
                                t = t * Transformation.from_frame(acm.collision_mesh.frame)

                            mesh = acm.collision_mesh.mesh.transformed(t)
    
                            attached_meshes.extend(SceneObject(mesh).draw())

                    cached_scene["acm"] = attached_meshes

                attached_meshes = cached_scene.get("acm", [])

                cached_scene["time"] = time.time()
                st[cached_scene_key] = cached_scene

        return (
            visual,
            collision,
            collision_meshes,
            attached_meshes,
            frames,
            base_frame,
            ee_frame,
        )
# ---------- end compas_fab_robot_visualize ----------
